# Grasshopper definition FacadeEmbed_JinQiao_Podium.gh (Grasshopper 1.0.7)
# plug-ins: EleFront, Wombat, TT Toolbox, Pufferfish, Hare, treesloth01

# ----
# 线段延长长度
number_slider = Slider(1001, range=0..10000)  # disabled

# ----
# remove duplicate curves
geo = Geometry()  # disabled
number_slider_2 = Slider(0.1, range=0..0.1)  # disabled
boundary = BoundarySurfaces(Edges=geo)  # disabled
area = Area(Geometry=boundary)  # -> Area, Centroid; disabled
cullduppoints = RemoveDuplicatePoints(InputPoints=area.Centroid, Tolerance=number_slider_2)  # -> OutputPoints, FirstPointIndexes; disabled
null = NullItem(Item=cullduppoints.FirstPointIndexes)  # -> NullFlags, InvalidFlags, Description; disabled
dispatch = Dispatch(List=boundary, DispatchPattern=null.NullFlags)  # -> ListA, ListB; disabled
geo_2 = Geometry(dispatch.ListA)  # disabled

# ----
# 调换阴阳角设定
toggle = BooleanToggle(False)  # disabled

# ----
# 按图层整理curves
# 2.Line-0-建筑
# 3.Line-1-结构
panel = Panel("Line-1-结构-Out")
reflay = ReferenceByLayer(LayerName="Line-0-建筑-Whole")
reflay_2 = ReferenceByLayer(LayerName="Line-1-檐口")
reflay_3 = ReferenceByLayer(LayerName=panel)
reflay_4 = ReferenceByLayer(LayerName="Line-1-结构-All")

# ----
# 1.按图层整理curves
# 1.Line-1-建筑-
panel_2 = Panel("Line-1-建筑-Whole")
reflay_5 = ReferenceByLayer(LayerName=panel_2)

# ----
# （3）导入局部单体建筑的参考线
# 按照图层导入建筑、结构、檐口线
panel_3 = Panel("Line-1-檐口-吊顶处理")
reflay_6 = ReferenceByLayer(LayerName=panel_3)
reflay_7 = ReferenceByLayer(LayerName="Line-1-檐口-车道等灰空间")
xy = XYPlane(Origin=Point(0, 0, 0))
xy_2 = XYPlane(Origin=Point(0, 0, 0))
xy_3 = XYPlane(Origin=Point(0, 0, 0))
xy_4 = XYPlane(Origin=Point(0, 0, 0))
xy_5 = XYPlane(Origin=Point(0, 0, 0))
xy_6 = XYPlane(Origin=Point(0, 0, 0))
xy_7 = XYPlane(Origin=Point(0, 0, 0))
project = Project(Geometry=reflay_5, Plane=xy)  # -> Geometry, Transform
project_2 = Project(Geometry=reflay, Plane=xy_2)  # -> Geometry, Transform
project_3 = Project(Geometry=reflay_2, Plane=xy_3)  # -> Geometry, Transform
project_4 = Project(Geometry=reflay_3, Plane=xy_4)  # -> Geometry, Transform
project_5 = Project(Geometry=reflay_4, Plane=xy_5)  # -> Geometry, Transform
project_6 = Project(Geometry=reflay_6, Plane=xy_6)  # -> Geometry, Transform
project_7 = Project(Geometry=reflay_7, Plane=xy_7)  # -> Geometry, Transform
crv = Curve(project.Geometry)
crv_2 = Curve(project_4.Geometry)
crv_3 = Curve(project_5.Geometry)
crv_4 = Curve(project_2.Geometry)
crv_5 = Curve(project_3.Geometry)
crv_6 = Curve(<curve referenced from the Rhino model>)
crv_7 = Curve(project_7.Geometry)
crv_8 = Curve(project_6.Geometry)

# ----
# Input Blocks (Correct Plan)
# 主体定位点
data = Data(["PX-GLAZ-F2$0$PX-GLAZ-F1$0$标准块", "PX-GLAZ-F2$0$PX-GLAZ-F2$0$标准块", "PX-GLAZ-F2$0$PX-GLAZ-F3$0$标准块"])

# ----
# Input Curves
# 主体定位点（按图层导入）
crv_9 = Curve(<curve referenced from the Rhino model>)

# ----
# Input Blocks (Wrong Plan)
# 主体定位点
data_2 = Data("PX-GLAZ-F2$0$T3T")

# ----
# （1）导入埋件定位点
# Block & Curve的形式
# block names
listblockd = ListBlockDocument()
panel_4 = Panel(listblockd)

# ----
# 按图层整理curves
# 1.导入建筑线：Arch_curve_
panel_5 = Panel("Arch_curve_smooth")
reflay_8 = ReferenceByLayer(LayerName="Arch_curve_Whole")
reflay_9 = ReferenceByLayer(LayerName=panel_5)
reflay_10 = ReferenceByLayer(LayerName="Arch_curve_withLocation")
reflay_11 = ReferenceByLayer(LayerName="Arch_curve_angular")

# ----
# 特殊建筑线
# This Project Only
panel_6 = Panel("Arch_curve_other")
reflay_12 = ReferenceByLayer(LayerName=panel_6)

# ----
# 1.输入block names
data_3 = Data(["PX-GLAZ-F2$0$PX-GLAZ-F2$0$fin", "PX-GLAZ-F2$0$PX-GLAZ-F1$0$fin"])
panel_7 = Panel(data_3)

# ----
# （0）Prep
# 检测Block的Plane
# Later:
# 1.Block -Plane-不同方向合并处理
# 
# 2.双层幕墙的处理
# block names
listblockd_2 = ListBlockDocument()
panel_9 = Panel(listblockd_2)
refblock = ReferenceBlockByName(BlockName=panel_7)
deblock = DeconstructBlock(Block=refblock)  # -> Name, Plane, Geometry

# ----
# 2.导入所有结构线
panel_10 = Panel("Structure_curve_all")
reflay_13 = ReferenceByLayer(LayerName=panel_10)

# ----
# 单体选型
list = ValueList({"板埋": 0, "槽埋": 1, "板槽埋": 2}, selected="槽埋")
list_2 = ValueList({"顶埋": 0, "侧埋": 1}, selected="顶埋")
panel_11 = Panel(list)
panel_12 = Panel(list_2)

layer = ObjectLayer(Guid=crv_9)  # -> LayerIndex, LayerPathName
panel_13 = Panel(data)
panel_15 = Panel(data_2)
panel_16 = Panel(layer.LayerPathName)
refblock_2 = ReferenceBlockByName(BlockName=panel_13)
refblock_3 = ReferenceBlockByName(BlockName=panel_15)
reflay_14 = ReferenceByLayer(LayerName=panel_16)
xy_8 = XYPlane(Origin=Point(0, 0, 0))
xy_9 = XYPlane(Origin=Point(0, 0, 0))
xy_10 = XYPlane(Origin=Point(0, 0, 0))
project_8 = Project(Geometry=refblock_3, Plane=xy_10)  # -> Geometry, Transform
project_9 = Project(Geometry=refblock_2, Plane=xy_9)  # -> Geometry, Transform
project_10 = Project(Geometry=reflay_14, Plane=xy_8)  # -> Geometry, Transform

# ---- group: 结构线
crv_10 = Curve(<curve referenced from the Rhino model>)

# ----
# 平面定位INPUT
crv_11 = Curve([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])

# ---- group: 玻璃线
玻璃线 = Curve(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)
玻璃线_2 = Curve(<curve referenced from the Rhino model>)
玻璃线_3 = Curve(<curve referenced from the Rhino model>)

# ---- group: 定位竖料
crv_12 = Curve([<curve referenced from the Rhino model> x300])
crv_13 = Curve([<curve referenced from the Rhino model> x180])
crv_14 = Curve([<curve referenced from the Rhino model> x383])

# ----
# （2）导入整个site的参考线
# 按照图层导入所有的建筑、结构、檐口线
xy_11 = XYPlane(Origin=Point(0, 0, 0))
xy_12 = XYPlane(Origin=Point(0, 0, 0))
xy_13 = XYPlane(Origin=Point(0, 0, 0))
xy_14 = XYPlane(Origin=Point(0, 0, 0))
xy_15 = XYPlane(Origin=Point(0, 0, 0))
xy_16 = XYPlane(Origin=Point(0, 0, 0))
project_11 = Project(Geometry=reflay_8, Plane=xy_11)  # -> Geometry, Transform
project_12 = Project(Geometry=reflay_9, Plane=xy_12)  # -> Geometry, Transform
project_13 = Project(Geometry=reflay_10, Plane=xy_13)  # -> Geometry, Transform
project_14 = Project(Geometry=reflay_11, Plane=xy_14)  # -> Geometry, Transform
project_15 = Project(Geometry=reflay_12, Plane=xy_15)  # -> Geometry, Transform
project_16 = Project(Geometry=reflay_13, Plane=xy_16)  # -> Geometry, Transform
crv_15 = Curve(project_12.Geometry)
crv_16 = Curve(project_13.Geometry)
crv_17 = Curve(project_14.Geometry)
crv_18 = Curve(project_11.Geometry)
crv_19 = Curve(project_15.Geometry)
crv_20 = Curve(project_16.Geometry)

# ---- group: 混凝土
# 板埋几何INPUT
list_3 = ValueList({"C15": 0, "C20": 1, "C25": 2, "C30": 3, "C35": 4, "C40": 5}, selected="C35")

# ---- group: 钢筋牌号
list_4 = ValueList({"HPB300": 0, "HRB400": 1}, selected="HPB300")

# ---- group: 直径
list_5 = ValueList({"10": 0, "12": 1, "16": 2, "18": 3, "20": 4, "25": 5}, selected="12")

# ---- group: 列
list_6 = ValueList({"2X": 0, "3X": 1, "4X": 2}, selected="3X")

# ---- group: 行
list_7 = ValueList({"2Y": 0, "3Y": 1, "4Y": 2}, selected="2Y")

# ---- group: 锚筋间距
s_x = Slider(22, range=14..60, expression="X*5")
s_y = Slider(22, range=14..60, expression="X*5")

# ----
crv_21 = Curve([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])

# ----
# 2.检测plane是否存在
pln = Plane(deblock.Plane)

# ----
# 槽埋-角部选择
list_8 = ValueList({"槽埋角部-L形": 0, "槽埋角部-I形": 1}, selected="槽埋角部-I形")

join = JoinCurves(Curves=crv_21, Preserve=False)

# ----
# 3.如果不存在则Blake geometry
# 并在rhino里面清理线段
geo_3 = Geometry(deblock.Geometry)

flip = FlipCurve(Curve=玻璃线)  # -> Curve, Flag
boundary_2 = BoundarySurfaces(Edges=join)
filter = StreamFilter(Gate=Toggle(True), Stream0=玻璃线, Stream1=flip.Curve)
sunion = SolidUnion(Breps=boundary_2)
offset = OffsetCurve(Curve=filter, Distance=expr("-x", Slider(375, range=0..1000)), Corners=1)
area_2 = Area(Geometry=sunion)  # -> Area, Centroid
pt = Point(area_2.Centroid)
explode = Explode(Curve=offset, Recursive=True)  # -> Segments, Vertices
pt_2 = Point(explode.Vertices)
entwine = Entwine(Branch00=sunion, Branch01=pt, FlattenInputs=True)
max = Maximum(A=s_x, B=s_y)
flip_2 = FlipMatrix(Data=entwine)
filter_2 = StreamFilter(Gate=list_3, Stream0=7.2, Stream1=9.6, Stream2=11.9, Stream3=14.3, Stream4=16.7, Stream5=19.1)
filter_3 = StreamFilter(Gate=list_4, Stream0=270, Stream1=360)
filter_4 = StreamFilter(Gate=list_5, Stream0=10, Stream1=12, Stream2=16, Stream3=18, Stream4=20, Stream5=25)
filter_5 = StreamFilter(Gate=list_3, Stream0=0.91, Stream1=1.1, Stream2=1.27, Stream3=1.43, Stream4=1.57, Stream5=1.71)
filter_6 = StreamFilter(Gate=list_4, Stream0=0.16, Stream1=0.14)
addition = Addition(A=list_6, B=1)
addition_2 = Addition(A=list_7, B=1)
division = Division(A=max, B=8)

# ---- group: 建筑定位轮廓
item = ListItem(List=flip_2, Index="0", Wrap=True)  # -> flatten(Item)

# ---- group: 埋件定位点
item_2 = ListItem(List=flip_2, Index="-1", Wrap=True)  # -> flatten(Item)

# ----
t = Integer(division)
panel_17 = Panel(filter_5)
panel_18 = Panel(filter_2)
panel_19 = Panel(filter_6)
min = Minimum(A=filter_3, B=300)
panel_20 = Panel(min)
expression = Expression(A=filter_6, fy=filter_3, ft=filter_5, d=filter_4, Expression="(int((0.6*1.1*A*fy/ft*d)/5)+1)*5")

# ----
# 导入槽埋模型
brep = Brep(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)

# ---- group: 槽埋
# 槽埋Modeling
brep_2 = Brep(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)
bbox = BoundingBox(Content=brep, Plane=PlaneXY(0, 0, 0))  # -> Box, Box_2
debox = DeconstructBox(Box=bbox.Box)  # -> Plane, X, Y, Z
area_3 = Area(Geometry=brep)  # -> Area, Centroid
pdecon = Deconstruct(Point=area_3.Centroid)  # -> XComponent, YComponent, ZComponent
dedomain = DeconstructDomain(Domain=debox.Z)  # -> Start, End
xy_17 = XYPlane(Origin=Point(0, 0, 0))
pt_3 = ConstructPoint(XCoordinate=pdecon.XComponent, YCoordinate=pdecon.YComponent, ZCoordinate=dedomain.End)
pl_origin = PlaneOrigin(Base=xy_17, Origin=pt_3)
xy_18 = XYPlane(Origin=Point(0, 0, 0))
orient = Orient(Geometry=brep, Source=pl_origin, Target=xy_18)  # -> Geometry, Transform

# ----
edges = BrepEdges(Brep=bbox.Box)  # -> Naked, Interior, NonManifold
item_3 = ListItem(List=edges.Interior, Index="5", Wrap=True)
item_4 = ListItem(List=edges.Interior, Index="4", Wrap=True)
clx = CurveLine(Curve=item_4, Line=item_3)  # -> Points, Params, Count
Y = UnitY(Factor=item_3)
rotate = Rotate(Geometry=brep, Angle=1.570796327, Plane=clx.Points)  # -> Geometry, Transform
move = Move(Geometry=rotate.Geometry, Motion=Y)  # -> Geometry, Transform
merge = Merge(Data1=brep, Data2=move.Geometry)  # -> flatten(Result)
sunion_2 = SolidUnion(Breps=merge)
bbox_2 = BoundingBox(Content=sunion_2, Plane=PlaneXY(0, 0, 0))  # -> Box, Box_2
area_4 = Area(Geometry=sunion_2)  # -> Area, Centroid
debox_2 = DeconstructBox(Box=bbox_2.Box)  # -> Plane, X, Y, Z
pdecon_2 = Deconstruct(Point=area_4.Centroid)  # -> XComponent, YComponent, ZComponent
dedomain_2 = DeconstructDomain(Domain=debox_2.Z)  # -> Start, End
pt_4 = ConstructPoint(XCoordinate=pdecon_2.XComponent, YCoordinate=pdecon_2.YComponent, ZCoordinate=dedomain_2.End)
xy_19 = XYPlane(Origin=Point(0, 0, 0))
pl_origin_2 = PlaneOrigin(Base=xy_19, Origin=pt_4)
xy_20 = XYPlane(Origin=Point(0, 0, 0))
orient_2 = Orient(Geometry=sunion_2, Source=pl_origin_2, Target=xy_20)  # -> Geometry, Transform

# ----
# 导入槽埋模型
brep_3 = Brep(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)

filter_7 = StreamFilter(Gate=list_8, Stream0=orient_2.Geometry, Stream1=orient.Geometry)
entwine_2 = Entwine(Branch00=orient.Geometry, Branch01=filter_7, FlattenInputs=True)
crv_22 = Curve(offset)
crv_23 = Curve([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])
crv_24 = Curve(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)
merge_2 = Merge(Data1=crv_23, Data2=crv_24)

# ----
# 选要重塑的线段长度
number_slider_3 = Slider(1200, range=0..10000)

# ----
# 调整重塑线段的平滑度
number_slider_4 = Slider(11, range=0..11)

# ----
# 根据F2建筑线制作轮廓线
crv_25 = Curve(crv)
explode_2 = Explode(Curve=crv_25, Recursive=True)  # -> Segments, Vertices
len = Length(Curve=explode_2.Segments)
sort = SortList(Keys=len)  # -> Keys, ValuesA
larger = LargerThan(FirstNumber=len, SecondNumber=number_slider_3)  # -> LargerThan, OrEqualTo
panel_21 = Panel(sort.Keys)
dispatch_2 = Dispatch(List=explode_2.Segments, DispatchPattern=larger.LargerThan)  # -> ListA, ListB
data_4 = Data(dispatch_2.ListA)
data_5 = Data(dispatch_2.ListB)
join_2 = JoinCurves(Curves=data_5, Preserve=False)
disc = Discontinuity(Curve=join_2, Level=1)  # -> Points, Parameters
nurbs = NurbsCurve(Vertices=disc.Points, Degree=number_slider_4, Periodic=False)  # -> flatten(Curve), Length, Domain
join_3 = JoinCurves(Curves=flatten([data_4, nurbs.Curve]), Preserve=False)
offset_2 = OffsetCurve(Curve=join_3, Distance=Slider(6859, range=0..10000), Corners=1)

# ----
# Default Curve
reb = RebuildCurve(Curve=offset_2, Count=Slider(17, range=0..100), Tangents=invert(False))

# ----
# InputCurve
crv_26 = Curve()

# ----
# Curve-框住要分析的建筑单体
# 如果要用自己导入Curve作为分析线，
# 请在InputCurve那里导入curve,
# 然后在上方的选型列表选择Input Curve。
# 
# 如果要用Grasshopper自动生成的Curve,
# 请在上方的选型列表选择Default Curve。
list_9 = ValueList({"Default Curve": 0, "Input Curve": 1}, selected="Default Curve")
filter_8 = StreamFilter(Gate=list_9, Stream0=reb, Stream1=crv_26)

# ----
# 梁宽根据tag
number_slider_5 = Slider(150, range=0..1000)

# ----
# 区分内外梁边线-精确offset还没加
crv_27 = Curve(crv_3)
crv_28 = Curve(filter_8)
offcrv = OffsetCurve(
    Curve=crv_27,
    Plane=PlaneXY(0, 0, 0),
    Distance=number_slider_5,
    BothSides=expr("-x", number_slider_5),
    Kinks=0,
    CapType="0")
midpt = CurveMiddle(Curve=offcrv)
midpt_2 = CurveMiddle(Curve=crv_27)
crv_29 = Curve(offcrv)
item_5 = ListItem(List=midpt, Index=0, Wrap=True)
item_6 = ListItem(List=crv_29, Index=0, Wrap=True)
item_7 = ListItem(List=crv_29, Index="-1", Wrap=True)
pull = PullPoint(Point=midpt_2, Geometry=crv_28, ClosestOnly=True)  # -> ClosestPoint, Distance
ln = Line(StartPoint=item_5, EndPoint=graft(pull.ClosestPoint))
graft = GraftTree(Tree=crv_27, IncludeEmptyLists=True, IncludeNullItems=True)
ccx = CurveCurve(CurveA=ln, CurveB=graft)  # -> Points, ParamsA, ParamsB
null_2 = NullItem(Item=ccx.Points)  # -> NullFlags, InvalidFlags, Description
dispatch_3 = Dispatch(List=item_7, DispatchPattern=null_2.InvalidFlags)  # -> ListA, ListB
dispatch_4 = Dispatch(List=item_6, DispatchPattern=null_2.InvalidFlags)  # -> ListA, ListB

# ----
# 梁边线-内
merge_3 = Merge(Data1=dispatch_4.ListB, Data2=dispatch_3.ListA)

# ----
# 梁边线-外
merge_4 = Merge(Data1=dispatch_4.ListA, Data2=dispatch_3.ListB)

# ----
# 埋件向外探索最远出的梁的距离
number_slider_6 = Slider(5000, range=0..10000)

# ----
# 1.0无檐口线+上下层幕墙边线连续
# 01：钢板焊埋件[钢梁外侧]
# @钢边梁宽@钢边梁高
list_10 = ValueList({"优化定位": 0, "Default定位": 1}, selected="优化定位")

# ----
# 是否有吊顶：
# 下层幕墙边线在结构边梁以内>350
# 
# （最外层结构线）
number_slider_7 = Slider(350, range=0..1000)

crv_30 = Curve(crv_4)

# ----
# 2.1下层建筑边线外侧50-350mm范围内
number_slider_8 = Slider(350, range=0..1000)
crv_31 = Curve(crv_30)
offset_3 = OffsetCurve(Curve=crv_31, Distance=Slider(50, range=0..100), Corners=1)
offset_4 = OffsetCurve(Curve=crv_31, Distance=number_slider_8, Corners=1)

# ----
# 2.2下层建筑边线内侧300-600mm范围内
number_slider_9 = Slider(600, range=0..1000)
crv_32 = Curve(crv_30)
offset_5 = OffsetCurve(Curve=crv_32, Distance=expr("-x", Slider(300, range=0..1000)), Corners=1)
offset_6 = OffsetCurve(Curve=crv_32, Distance=expr("-x", number_slider_9), Corners=1)

# ----
# 下层建筑内侧到300到外侧50内
# 有钢结构
number_slider_10 = Slider(50, range=0..1000)
crv_33 = Curve(crv_30)
offset_7 = OffsetCurve(Curve=crv_33, Distance=expr("-x", Slider(300, range=0..1000)), Corners=1)
offset_8 = OffsetCurve(Curve=crv_33, Distance=number_slider_10, Corners=1)

# ----
# Sort Text
panel_22 = Panel("""T2-PLAN-F2$0$次梁编号
T2-PLAN-F2$0$框梁编号""")
reflay_15 = ReferenceByLayer(LayerName=panel_22)  # -> flatten(Geometry)
panel_23 = Panel("""GL3-1
GL4-1
GL5-1
GL5-2
GL6-1
GL6-2
GKL6-2
GL7-1
GL7-2
GKL7-1
GL8-1
GL8-2
GKl7-1
GKl7-4
GKL9-2
GL10-1
GL10-4
GKL10-2
GKL10-4
GL12-1""")
detext = DeconstructText(TextObject=reflay_15)  # -> Text, Plane, Height, Justification
lng = ListLength(List=detext.Text)
tmatch = MatchText(Text=detext.Text, Pattern=graft(panel_23), Case=True)
tsort = SortText(Keys=detext.Text, Culture=127)  # -> Keys, Values
pt_5 = Point(detext.Plane)
dispatch_5 = Dispatch(List=reflay_15, DispatchPattern=tmatch)  # -> ListA, ListB
panel_24 = Panel(lng)
panel_25 = Panel(tsort.Keys)
data_6 = Data(dispatch_5.ListA)
bang = ExplodeTree(Data=data_6)  # -> Branch0, Branch1, Branch2, Branch3, Branch4, Branch5, Branch6, Branch7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
flatten = FlattenTree(Tree=data_6, Path="{0}")
lng_2 = ListLength(List=flatten)
equals = Equality(FirstNumber=panel_24, SecondNumber=lng_2)  # -> Equality, Inequality
filter_9 = StreamFilter(Gate=equals.Equality, Stream0="Missing Text!", Stream1="Correct!")
panel_26 = Panel(filter_9)
detext_2 = DeconstructText(TextObject=bang.Branch0)  # -> Text, Plane, Height, Justification
detext_3 = DeconstructText(TextObject=bang.Branch1)  # -> Text, Plane, Height, Justification
detext_4 = DeconstructText(TextObject=bang.Branch2)  # -> Text, Plane, Height, Justification
detext_5 = DeconstructText(TextObject=bang.Branch3)  # -> Text, Plane, Height, Justification
detext_6 = DeconstructText(TextObject=bang.Branch4)  # -> Text, Plane, Height, Justification
detext_7 = DeconstructText(TextObject=bang.Branch5)  # -> Text, Plane, Height, Justification
detext_8 = DeconstructText(TextObject=bang.Branch6)  # -> Text, Plane, Height, Justification
detext_9 = DeconstructText(TextObject=bang.Branch7)  # -> Text, Plane, Height, Justification
detext_10 = DeconstructText(TextObject=bang.Branch8)  # -> Text, Plane, Height, Justification
detext_11 = DeconstructText(TextObject=bang.Branch9)  # -> Text, Plane, Height, Justification
detext_12 = DeconstructText(TextObject=bang.Branch10)  # -> Text, Plane, Height, Justification
detext_13 = DeconstructText(TextObject=bang.Branch11)  # -> Text, Plane, Height, Justification
detext_14 = DeconstructText(TextObject=bang.Branch12)  # -> Text, Plane, Height, Justification
detext_15 = DeconstructText(TextObject=bang.Branch13)  # -> Text, Plane, Height, Justification
detext_16 = DeconstructText(TextObject=bang.Branch14)  # -> Text, Plane, Height, Justification
detext_17 = DeconstructText(TextObject=bang.Branch15)  # -> Text, Plane, Height, Justification
detext_18 = DeconstructText(TextObject=bang.Branch16)  # -> Text, Plane, Height, Justification
detext_19 = DeconstructText(TextObject=bang.Branch17)  # -> Text, Plane, Height, Justification
detext_20 = DeconstructText(TextObject=bang.Branch18)  # -> Text, Plane, Height, Justification
detext_21 = DeconstructText(TextObject=bang.Branch19)  # -> Text, Plane, Height, Justification
pt_6 = Point(detext_3.Plane)
pt_7 = Point(detext_9.Plane)
pt_8 = Point(detext_14.Plane)
pt_9 = Point(detext_15.Plane)
pt_10 = Point(detext_16.Plane)
pt_11 = Point(detext_17.Plane)
pt_12 = Point(detext_18.Plane)
pt_13 = Point(detext_2.Plane)
pt_14 = Point(detext_4.Plane)
pt_15 = Point(detext_5.Plane)
pt_16 = Point(detext_6.Plane)
pt_17 = Point(detext_7.Plane)
pt_18 = Point(detext_8.Plane)
pt_19 = Point(detext_10.Plane)
pt_20 = Point(detext_11.Plane)
pt_21 = Point(detext_12.Plane)
pt_22 = Point(detext_13.Plane)
pt_23 = Point(detext_19.Plane)
pt_24 = Point(detext_20.Plane)
pt_25 = Point(detext_21.Plane)
merge_5 = Merge(
    Data1=pt_13,
    Data2=pt_6,
    Data3=pt_14,
    Data4=pt_15,
    Data5=pt_16,
    Data6=pt_17,
    Data7=pt_18,
    Data8=pt_7,
    Data9=pt_19,
    Data10=pt_20,
    Data11=pt_21,
    Data12=pt_8,
    Data13=pt_9,
    Data14=pt_10,
    Data15=pt_11,
    Data16=pt_12,
    Data17=pt_23,
    Data18=pt_22,
    Data19=pt_24,
    Data20=pt_25)
flatten_2 = FlattenTree(Tree=merge_5, Path="{0}")

# ----
# 求内部曲线转折点
crv_34 = Curve()  # disabled
number_slider_11 = Slider(300, range=0..1000)  # disabled
neg = Negative(Value=number_slider_11)  # disabled
filter_10 = StreamFilter(Gate=toggle, Stream0=number_slider_11, Stream1=neg)  # disabled
number_slider_12 = Slider(60, range=0..100)  # disabled

ext = ExtendCurve(Curve=crv_34, Type=0, Start=number_slider, End=number_slider)  # disabled

# ----
# 第二层
# 
# Curves(location point)+ Smooth Curves(architecture line)
# 第二层-区分阴阳角
area_5 = Area(Geometry=geo_2)  # -> Area, Centroid; disabled
crv_35 = Curve(crv_34)  # disabled
pull_2 = PullPoint(Point=area_5.Centroid, Geometry=crv_35, ClosestOnly=True)  # -> ClosestPoint, Distance; disabled
number_slider_13 = Slider(200, range=0..1000)  # disabled
number_slider_14 = Slider(100, range=0..300)  # disabled

# ----
# 第二层-阴阳角
panel_27 = Panel("0.5 * Pi")  # disabled
toggle_2 = BooleanToggle(True)  # disabled
neg_2 = Negative(Value=panel_27)  # disabled
filter_11 = StreamFilter(Gate=toggle_2, Stream0=panel_27, Stream1=neg_2)  # disabled

# ----
# 第二层-大面定位
panel_28 = Panel("0.5 * Pi")  # disabled
toggle_3 = BooleanToggle(True)  # disabled
neg_3 = Negative(Value=panel_28)  # disabled
filter_12 = StreamFilter(Gate=toggle_3, Stream0=panel_28, Stream1=neg_3)  # disabled

number_slider_15 = Slider(300, range=0..1000)  # disabled
number_slider_16 = Slider(1.5, range=0..10)  # disabled

number_slider_17 = Slider(300, range=0..1000)  # disabled
number_slider_18 = Slider(1.5, range=0..10)  # disabled

number_slider_19 = Slider(300, range=0..1000)  # disabled
number_slider_20 = Slider(1.5, range=0..10)  # disabled

# ----
# 显示"False"时要选择线段延长
list_11 = ValueList({"线段不延长": 0, "线段延长": 1}, selected="线段延长")  # disabled

filter_13 = StreamFilter(Gate=list_11, Stream0=crv_34, Stream1=ext)  # disabled

disc_2 = Discontinuity(Curve=graft(filter_13), Level=1)  # -> Points, Parameters; disabled
crv_cp = CurveClosestPoint(Point=disc_2.Points, Curve=graft(filter_13))  # -> Point, Parameter, Distance; disabled
eval = EvaluateCurve(Curve=graft(filter_13), Parameter=crv_cp.Parameter)  # -> flatten(Point), Tangent, flatten(Angle); disabled
deg = Degrees(Radians=eval.Angle)  # disabled
offset_9 = OffsetCurve(Curve=filter_13, Distance=expr("-X", filter_10), Corners=1)  # disabled
panel_29 = Panel(deg)  # disabled
larger_2 = LargerThan(FirstNumber=deg, SecondNumber=number_slider_12)  # -> LargerThan, OrEqualTo; disabled
disc_3 = Discontinuity(Curve=offset_9, Level=1)  # -> flatten(Points), Parameters; disabled
dispatch_6 = Dispatch(List=eval.Point, DispatchPattern=larger_2.LargerThan)  # -> ListA, ListB; disabled
end = EndPoints(Curve=filter_13)  # -> Start, End; disabled
data_7 = Data(dispatch_6.ListA)  # disabled
pull_3 = PullPoint(Point=data_7, Geometry=flatten(offset_9), ClosestOnly=True)  # -> ClosestPoint, Distance; disabled
testpoint = TestPoint(archPoint=pull_3.ClosestPoint, crvPoint=disc_3.Points)  # -> out, specialPt; inputs archPoint: list of Point3d, crvPoint: list of Point3d; disabled
# ---------- testpoint: C# ----------
    List<int> passIndex = new List<int>();

    for(int i = 0; i < archPoint.Count; i++){
      foreach(Point3d t in crvPoint){
        if(archPoint[i].X == t.X && archPoint[i].Y == t.Y && archPoint[i].Z == t.Z){
          Print("pass");
          passIndex.Add(i);}
      }
    }

    specialPt = passIndex;
# ---------- end testpoint ----------

# ----
# 阴角
item_8 = ListItem(List=data_7, Index=testpoint.specialPt, Wrap=True)  # disabled

# ----
# SmoothCurve-阴角&阳角
# 阳角
cull_i = CullIndex(List=data_7, Indices=testpoint.specialPt, Wrap=True)  # disabled

dist = Distance(PointA=pull_2.ClosestPoint, PointB=data_7)  # disabled
sort_2 = SortList(Keys=dist)  # -> Keys, ValuesA; disabled
panel_30 = Panel(sort_2.Keys)  # disabled
smaller = SmallerThan(FirstNumber=dist, SecondNumber=number_slider_13)  # -> SmallerThan, OrEqualTo; disabled
dispatch_7 = Dispatch(List=geo_2, DispatchPattern=smaller.SmallerThan)  # -> ListA, ListB; disabled
crv_36 = Curve(filter_13)  # disabled

data_8 = Data(dispatch_7.ListA)  # disabled
explode_3 = Explode(Curve=data_8, Recursive=True)  # -> Segments, Vertices; disabled
len_2 = Length(Curve=explode_3.Segments)  # disabled
sort_3 = SortList(Keys=reverse(len_2), ValuesA=explode_3.Segments)  # -> Keys, ValuesA; disabled
item_9 = ListItem(List=sort_3.ValuesA, Index=0, Wrap=True)  # -> flatten(Item); disabled
area_6 = Area(Geometry=data_8)  # -> Area, Centroid; disabled
midpt_3 = CurveMiddle(Curve=item_9)  # disabled
move2pt = MoveToPoint(Geometry=item_9, PointA=midpt_3, PointB=area_6.Centroid)  # -> Moved, Vector, Transform; disabled
end_2 = EndPoints(Curve=move2pt.Moved)  # -> Start, End; disabled
ln_2 = Line(StartPoint=end_2.Start, EndPoint=end_2.End)  # disabled
xy_21 = XYPlane(Origin=end_2.End)  # disabled
rotate_2 = Rotate(Geometry=ln_2, Angle=filter_11, Plane=xy_21)  # -> Geometry, Transform; disabled
pl = ConstructPlane(Origin=end_2.End, XAxis=rotate_2.Geometry, YAxis=ln_2)  # disabled

data_9 = Data(dispatch_7.ListB)  # disabled
explode_4 = Explode(Curve=data_9, Recursive=True)  # -> Segments, Vertices; disabled
len_3 = Length(Curve=explode_4.Segments)  # disabled
sort_4 = SortList(Keys=reverse(len_3), ValuesA=explode_4.Segments)  # -> Keys, ValuesA; disabled
item_10 = ListItem(List=sort_4.ValuesA, Index=0, Wrap=True)  # -> flatten(Item); disabled
area_7 = Area(Geometry=data_9)  # -> Area, Centroid; disabled
midpt_4 = CurveMiddle(Curve=item_10)  # disabled
move2pt_2 = MoveToPoint(Geometry=item_10, PointA=midpt_4, PointB=area_7.Centroid)  # -> Moved, Vector, Transform; disabled
end_3 = EndPoints(Curve=move2pt_2.Moved)  # -> Start, End; disabled
ln_3 = Line(StartPoint=end_3.Start, EndPoint=end_3.End)  # disabled
xy_22 = XYPlane(Origin=end_3.End)  # disabled
rotate_3 = Rotate(Geometry=ln_3, Angle=filter_12, Plane=xy_22)  # -> Geometry, Transform; disabled
pl_2 = ConstructPlane(Origin=end_3.End, XAxis=rotate_3.Geometry, YAxis=ln_3)  # disabled

data_10 = Data(flatten(pl_2))  # disabled
deplane = DeconstructPlane(Plane=data_10)  # -> Origin, XAxis, YAxis, ZAxis; disabled
amp = Amplitude(Vector=deplane.YAxis, Amplitude=number_slider_17)  # disabled
move_2 = Move(Geometry=deplane.Origin, Motion=amp)  # -> Geometry, Transform; disabled
ln_4 = Line(StartPoint=deplane.Origin, EndPoint=move_2.Geometry)  # disabled
midpt_5 = CurveMiddle(Curve=ln_4)  # disabled
scale = Scale(Geometry=ln_4, Center=midpt_5, Factor=number_slider_18)  # -> Geometry, Transform; disabled
ccx_2 = CurveCurve(CurveA=scale.Geometry, CurveB=crv_36)  # -> Points, ParamsA, ParamsB; disabled

dist_2 = Distance(PointA=graft(end_2.End), PointB=cull_i)  # disabled
sort_5 = SortList(Keys=dist_2)  # -> Keys, ValuesA; disabled
item_11 = ListItem(List=sort_5.Keys, Index=0, Wrap=True)  # disabled
smaller_2 = SmallerThan(FirstNumber=item_11, SecondNumber=number_slider_14)  # -> SmallerThan, OrEqualTo; disabled
flatten_3 = FlattenTree(Tree=item_11, Path="{0}")  # disabled
dispatch_8 = Dispatch(List=graft(pl), DispatchPattern=smaller_2.SmallerThan)  # -> ListA, ListB; disabled
panel_31 = Panel(flatten_3)  # disabled
flatten_4 = FlattenTree(Tree=ccx_2.Points, Path="{0}")  # disabled
lng_3 = ListLength(List=scale.Geometry)  # disabled
lng_4 = ListLength(List=flatten_4)  # disabled

data_11 = Data(flatten(dispatch_8.ListA))  # disabled
deplane_2 = DeconstructPlane(Plane=data_11)  # -> Origin, XAxis, YAxis, ZAxis; disabled
amp_2 = Amplitude(Vector=deplane_2.YAxis, Amplitude=number_slider_15)  # disabled
move_3 = Move(Geometry=deplane_2.Origin, Motion=amp_2)  # -> Geometry, Transform; disabled
ln_5 = Line(StartPoint=deplane_2.Origin, EndPoint=move_3.Geometry)  # disabled
midpt_6 = CurveMiddle(Curve=ln_5)  # disabled
scale_2 = Scale(Geometry=ln_5, Center=midpt_6, Factor=number_slider_16)  # -> Geometry, Transform; disabled
ccx_3 = CurveCurve(CurveA=scale_2.Geometry, CurveB=crv_36)  # -> Points, ParamsA, ParamsB; disabled

data_12 = Data(flatten(dispatch_8.ListB))  # disabled
deplane_3 = DeconstructPlane(Plane=data_12)  # -> Origin, XAxis, YAxis, ZAxis; disabled
amp_3 = Amplitude(Vector=deplane_3.YAxis, Amplitude=number_slider_19)  # disabled
move_4 = Move(Geometry=deplane_3.Origin, Motion=amp_3)  # -> Geometry, Transform; disabled
ln_6 = Line(StartPoint=deplane_3.Origin, EndPoint=move_4.Geometry)  # disabled
midpt_7 = CurveMiddle(Curve=ln_6)  # disabled
scale_3 = Scale(Geometry=ln_6, Center=midpt_7, Factor=number_slider_20)  # -> Geometry, Transform; disabled
ccx_4 = CurveCurve(CurveA=scale_3.Geometry, CurveB=crv_36)  # -> Points, ParamsA, ParamsB; disabled

equals_2 = Equality(FirstNumber=lng_3, SecondNumber=lng_4)  # -> Equality, Inequality; disabled
panel_32 = Panel(equals_2.Equality)  # disabled

# ----
# InsideCurve-大面
move2pt_3 = MoveToPoint(Geometry=data_10, PointA=flatten(deplane.Origin), PointB=flatten(ccx_2.Points))  # -> Moved, Vector, Transform; disabled

# ----
# InsideCurve-阳角
move2pt_4 = MoveToPoint(Geometry=data_11, PointA=deplane_2.Origin, PointB=ccx_3.Points)  # -> Moved, Vector, Transform; disabled

# ----
# InsideCurve-阴角
move2pt_5 = MoveToPoint(Geometry=data_12, PointA=deplane_3.Origin, PointB=ccx_4.Points)  # -> Moved, Vector, Transform; disabled

# ----
# 测试Smooth Curve是否与每个Block相切
# blocks + smooth curves
# remove duplicate blocks
# blocks + special curves
deblock_2 = DeconstructBlock(Block=project_9.Geometry)  # -> Name, Plane, Geometry
pln_2 = Plane(flatten(deblock_2.Plane))
deplane_4 = DeconstructPlane(Plane=pln_2)  # -> Origin, XAxis, YAxis, ZAxis
cullduppoints_2 = RemoveDuplicatePoints(InputPoints=deplane_4.Origin, Tolerance=0.001)  # -> OutputPoints, FirstPointIndexes
null_3 = NullItem(Item=cullduppoints_2.FirstPointIndexes)  # -> NullFlags, InvalidFlags, Description
dispatch_9 = Dispatch(List=pln_2, DispatchPattern=null_3.InvalidFlags)  # -> ListA, ListB
dispatch_10 = Dispatch(List=flatten(project_9.Geometry), DispatchPattern=null_3.InvalidFlags)  # -> ListA, ListB
pln_3 = Plane(dispatch_9.ListA)
data_13 = Data(flatten(pln_3))
deplane_5 = DeconstructPlane(Plane=data_13)  # -> Origin, XAxis, YAxis, ZAxis
pln_4 = Plane(data_13)
amp_4 = Amplitude(Vector=deplane_5.YAxis, Amplitude=Slider(300, range=0..1000))
move_5 = Move(Geometry=deplane_5.Origin, Motion=amp_4)  # -> Geometry, Transform
ln_7 = Line(StartPoint=deplane_5.Origin, EndPoint=move_5.Geometry)
crv_37 = Curve(crv_15)
midpt_8 = CurveMiddle(Curve=ln_7)
scale_4 = Scale(Geometry=ln_7, Center=midpt_8, Factor=Slider(7.8, range=0..10))  # -> Geometry, Transform
merge_6 = Merge(Data1=scale_4.Geometry, Data2=crv_37)
mcx = MultipleCurves(Curves=flatten(merge_6))  # -> Points, IndexA, IndexB, ParamA, ParamB
cull_i_2 = CullIndex(List=flatten(pln_4), Indices=mcx.IndexA, Wrap=True)
item_12 = ListItem(List=pln_4, Index=mcx.IndexA, Wrap=True)
pln_5 = Plane(cull_i_2)
pln_6 = Plane(item_12)

deblock_3 = DeconstructBlock(Block=dispatch_10.ListA)  # -> Name, Plane, Geometry
data_14 = Data(dispatch_10.ListA)

cull_i_3 = CullIndex(List=flatten(data_14), Indices=mcx.IndexA, Wrap=True)
item_13 = ListItem(List=flatten(data_14), Index=mcx.IndexA, Wrap=True)
data_15 = Data(cull_i_3)
data_16 = Data(item_13)

# ----
# 第一层
# 
# Special Curves(architecture line)
crv_38 = Curve(crv_16)
pln_7 = Plane(pln_5)
deplane_6 = DeconstructPlane(Plane=pln_7)  # -> Origin, XAxis, YAxis, ZAxis
disc_4 = Discontinuity(Curve=crv_38, Level=1)  # -> Points, Parameters
pull_4 = PullPoint(Point=deplane_6.Origin, Geometry=disc_4.Points, ClosestOnly=True)  # -> ClosestPoint, Distance
sort_6 = SortList(Keys=pull_4.Distance)  # -> reverse(Keys), ValuesA
panel_33 = Panel(sort_6.Keys)
larger_3 = LargerThan(FirstNumber=pull_4.Distance, SecondNumber=Slider(300, range=0..1000))  # -> LargerThan, OrEqualTo
dispatch_11 = Dispatch(List=pln_7, DispatchPattern=larger_3.LargerThan)  # -> ListA, ListB
data_17 = Data(dispatch_11.ListB)
deplane_7 = DeconstructPlane(Plane=data_17)  # -> Origin, XAxis, YAxis, ZAxis
pull_5 = PullPoint(Point=deplane_7.Origin, Geometry=disc_4.Points, ClosestOnly=True)  # -> ClosestPoint, Distance
# SmoothCurve-正常
pl_3 = ConstructPlane(Origin=pull_5.ClosestPoint, XAxis=deplane_7.XAxis, YAxis=deplane_7.YAxis)

# ----
# 测试Smooth Curve是否与每个Block相切
# blocks + smooth curves
# remove duplicate blocks
# blocks + special curves
deblock_4 = DeconstructBlock(Block=project_8.Geometry)  # -> Name, Plane, Geometry
pln_8 = Plane(flatten(deblock_4.Plane))
deplane_8 = DeconstructPlane(Plane=pln_8)  # -> Origin, XAxis, YAxis, ZAxis
cullduppoints_3 = RemoveDuplicatePoints(InputPoints=deplane_8.Origin, Tolerance=0.001)  # -> OutputPoints, FirstPointIndexes
null_4 = NullItem(Item=cullduppoints_3.FirstPointIndexes)  # -> NullFlags, InvalidFlags, Description
dispatch_12 = Dispatch(List=pln_8, DispatchPattern=null_4.InvalidFlags)  # -> ListA, ListB
dispatch_13 = Dispatch(List=flatten(project_8.Geometry), DispatchPattern=null_4.InvalidFlags)  # -> ListA, ListB
pln_9 = Plane(dispatch_12.ListA)
data_18 = Data(flatten(pln_9))
deplane_9 = DeconstructPlane(Plane=data_18)  # -> Origin, XAxis, YAxis, ZAxis
pln_10 = Plane(data_18)
amp_5 = Amplitude(Vector=deplane_9.YAxis, Amplitude=Slider(300, range=0..1000))
move_6 = Move(Geometry=deplane_9.Origin, Motion=amp_5)  # -> Geometry, Transform
ln_8 = Line(StartPoint=deplane_9.Origin, EndPoint=move_6.Geometry)
crv_39 = Curve(crv_15)
midpt_9 = CurveMiddle(Curve=ln_8)
scale_5 = Scale(Geometry=ln_8, Center=midpt_9, Factor=Slider(7.8, range=0..10))  # -> Geometry, Transform
merge_7 = Merge(Data1=scale_5.Geometry, Data2=crv_39)
mcx_2 = MultipleCurves(Curves=flatten(merge_7))  # -> Points, IndexA, IndexB, ParamA, ParamB
cull_i_4 = CullIndex(List=flatten(pln_10), Indices=mcx_2.IndexA, Wrap=True)
item_14 = ListItem(List=pln_10, Index=mcx_2.IndexA, Wrap=True)
pln_11 = Plane(cull_i_4)
pln_12 = Plane(item_14)

deblock_5 = DeconstructBlock(Block=dispatch_13.ListA)  # -> Name, Plane, Geometry
data_19 = Data(dispatch_13.ListA)

cull_i_5 = CullIndex(List=flatten(data_19), Indices=mcx_2.IndexA, Wrap=True)
item_15 = ListItem(List=flatten(data_19), Index=mcx_2.IndexA, Wrap=True)
data_20 = Data(cull_i_5)
data_21 = Data(item_15)

# ---- group: 阴阳角区分
cp = ClosestPoint(Point=pt_2, Cloud=item_2)  # -> ClosestPoint, CPIndex, Distance
item_16 = ListItem(List=item_2, Index=cp.CPIndex, Wrap=True)
crv_cp_2 = CurveClosestPoint(Point=item_16, Curve=offset)  # -> Point, Parameter, Distance
eval_2 = EvaluateCurve(Curve=offset, Parameter=crv_cp_2.Parameter)  # -> Point, Tangent, Angle

# ----
# 板槽埋Modeling
multiplication = Multiplication(A=s_x, B=addition)
multiplication_2 = Multiplication(A=s_y, B=addition_2)
recgrid = Rectangular(Plane=PlaneXY(0, 0, 0), SizeX=s_x, SizeY=s_y, ExtentX=addition, ExtentY=addition_2)  # -> Cells, Points
直径 = Text(filter_4)
division_2 = Division(A=multiplication, B=2)
division_3 = Division(A=multiplication_2, B=2)
vec = VectorXYZ(XComponent=expr("-x", division_2), YComponent=expr("-x", division_3), ZComponent=0)  # -> Vector, Length
move_7 = Move(Geometry=recgrid.Points, Motion=vec.Vector)  # -> Geometry, Transform
division_4 = Division(A=直径, B=2)
cyl = Cylinder(Base=move_7.Geometry, Radius=division_4, Length=expr("-x", expression))
X = UnitX(Factor=直径)
multiplication_3 = Multiplication(A=直径, B=6)
edges_2 = BrepEdges(Brep=cyl)  # -> Naked, Interior, NonManifold
item_17 = ListItem(List=edges_2.Naked, Index=0, Wrap=True)
max_2 = Maximum(A=multiplication_3, B=70)
move_8 = Move(Geometry=item_17, Motion=X)  # -> Geometry, Transform
multiplication_4 = Multiplication(A=max_2, B=2)
addition_3 = Addition(A=multiplication, B=multiplication_4)
addition_4 = Addition(A=multiplication_2, B=multiplication_4)
division_5 = Division(A=t, B=2)
expression_2 = Expression(x=addition_4, Expression="Ceiling(x/10)*10/2")
expression_3 = Expression(x=addition_3, Expression="Ceiling(x/10)*10/2")
round = Round(Number=division_5)  # -> Nearest, Floor, Ceiling
multiplication_5 = Multiplication(A=round.Ceiling, B=2)
dom = ConstructDomain(DomainStart=expr("-x", expression_2), DomainEnd=expression_2)
dom_2 = ConstructDomain(DomainStart=expr("-x", expression_3), DomainEnd=expression_3)
box = DomainBox(Base=PlaneXY(0, 0, 0), X=dom_2, Y=dom, Z=multiplication_5)
Z = UnitZ(Factor=expr("-x", multiplication_5))

multiplication_6 = Multiplication(A=直径, B=5)

Z_2 = UnitZ(Factor=multiplication_6)
extr = Extrude(Base=move_8.Geometry, Direction=Z_2)
cap = CapHoles(Brep=[extr, cyl])
merge_8 = Merge(Data1=cap, Data2=box)
flatten_5 = FlattenTree(Tree=merge_8, Path="{0}")
move_9 = Move(Geometry=flatten_5, Motion=Z)  # -> Geometry, Transform

brep_4 = Brep(move_9.Geometry)

# ----
# 槽埋+板埋合并
bbox_3 = BoundingBox(Content=brep_3, Plane=PlaneXY(0, 0, 0))  # -> Box, Box_2
debox_3 = DeconstructBox(Box=bbox_3.Box)  # -> Plane, X, Y, Z
area_8 = Area(Geometry=brep_3)  # -> Area, Centroid
dedomain_3 = DeconstructDomain(Domain=debox_3.Z)  # -> Start, End
pdecon_3 = Deconstruct(Point=area_8.Centroid)  # -> XComponent, YComponent, ZComponent
xy_23 = XYPlane(Origin=Point(0, 0, 0))
pt_26 = ConstructPoint(XCoordinate=pdecon_3.XComponent, YCoordinate=pdecon_3.YComponent, ZCoordinate=dedomain_3.End)
pl_origin_3 = PlaneOrigin(Base=xy_23, Origin=pt_26)
xy_24 = XYPlane(Origin=Point(0, 0, 0))
orient_3 = Orient(Geometry=brep_3, Source=pl_origin_3, Target=xy_24)  # -> Geometry, Transform
bbox_4 = BoundingBox(Content=orient_3.Geometry, Plane=PlaneXY(0, 0, 0))  # -> Box, Box_2
sdiff = SolidDifference(BrepsA=move_9.Geometry, BrepsB=bbox_4.Box)
sunion_3 = SolidUnion(Breps=[sdiff, orient_3.Geometry])  # -> flatten(Result)

edges_3 = BrepEdges(Brep=bbox_3.Box)  # -> Naked, Interior, NonManifold
item_18 = ListItem(List=edges_3.Interior, Index="5", Wrap=True)
item_19 = ListItem(List=edges_3.Interior, Index="4", Wrap=True)
clx_2 = CurveLine(Curve=item_19, Line=item_18)  # -> Points, Params, Count
Y_2 = UnitY(Factor=item_18)
rotate_4 = Rotate(Geometry=brep_3, Angle=1.570796327, Plane=clx_2.Points)  # -> Geometry, Transform
move_10 = Move(Geometry=rotate_4.Geometry, Motion=Y_2)  # -> Geometry, Transform
merge_9 = Merge(Data1=brep_3, Data2=move_10.Geometry)  # -> flatten(Result)
sunion_4 = SolidUnion(Breps=merge_9)
bbox_5 = BoundingBox(Content=sunion_4, Plane=PlaneXY(0, 0, 0))  # -> Box, Box_2
area_9 = Area(Geometry=sunion_4)  # -> Area, Centroid
debox_4 = DeconstructBox(Box=bbox_5.Box)  # -> Plane, X, Y, Z
pdecon_4 = Deconstruct(Point=area_9.Centroid)  # -> XComponent, YComponent, ZComponent
dedomain_4 = DeconstructDomain(Domain=debox_4.Z)  # -> Start, End
pt_27 = ConstructPoint(XCoordinate=pdecon_4.XComponent, YCoordinate=pdecon_4.YComponent, ZCoordinate=dedomain_4.End)
xy_25 = XYPlane(Origin=Point(0, 0, 0))
pl_origin_4 = PlaneOrigin(Base=xy_25, Origin=pt_27)
xy_26 = XYPlane(Origin=Point(0, 0, 0))
orient_4 = Orient(Geometry=sunion_4, Source=pl_origin_4, Target=xy_26)  # -> Geometry, Transform

entwine_3 = Entwine(Branch00=sunion_3, Branch01=orient_4.Geometry, FlattenInputs=True)

# ----
# 板埋Modeling
multiplication_7 = Multiplication(A=s_x, B=addition)
multiplication_8 = Multiplication(A=s_y, B=addition_2)
recgrid_2 = Rectangular(Plane=PlaneXY(0, 0, 0), SizeX=s_x, SizeY=s_y, ExtentX=addition, ExtentY=addition_2)  # -> Cells, Points
直径_2 = Text(filter_4)
division_6 = Division(A=multiplication_7, B=2)
division_7 = Division(A=multiplication_8, B=2)
vec_2 = VectorXYZ(XComponent=expr("-x", division_6), YComponent=expr("-x", division_7), ZComponent=0)  # -> Vector, Length
move_11 = Move(Geometry=recgrid_2.Points, Motion=vec_2.Vector)  # -> Geometry, Transform
division_8 = Division(A=直径_2, B=2)
cyl_2 = Cylinder(Base=move_11.Geometry, Radius=division_8, Length=expr("-x", expression))
X_2 = UnitX(Factor=直径_2)
multiplication_9 = Multiplication(A=直径_2, B=6)
edges_4 = BrepEdges(Brep=cyl_2)  # -> Naked, Interior, NonManifold
item_20 = ListItem(List=edges_4.Naked, Index=0, Wrap=True)
max_3 = Maximum(A=multiplication_9, B=70)
move_12 = Move(Geometry=item_20, Motion=X_2)  # -> Geometry, Transform
multiplication_10 = Multiplication(A=max_3, B=2)
addition_5 = Addition(A=multiplication_7, B=multiplication_10)
addition_6 = Addition(A=multiplication_8, B=multiplication_10)
division_9 = Division(A=t, B=2)
expression_4 = Expression(x=addition_6, Expression="Ceiling(x/10)*10/2")
expression_5 = Expression(x=addition_5, Expression="Ceiling(x/10)*10/2")
round_2 = Round(Number=division_9)  # -> Nearest, Floor, Ceiling
multiplication_11 = Multiplication(A=round_2.Ceiling, B=2)
dom_3 = ConstructDomain(DomainStart=expr("-x", expression_4), DomainEnd=expression_4)
dom_4 = ConstructDomain(DomainStart=expr("-x", expression_5), DomainEnd=expression_5)
box_2 = DomainBox(Base=PlaneXY(0, 0, 0), X=dom_4, Y=dom_3, Z=multiplication_11)
Z_3 = UnitZ(Factor=expr("-x", multiplication_11))
move_13 = Move(Geometry=box_2, Motion=Z_3)  # -> Geometry, Transform
Z_4 = UnitZ(Factor=expr("-x", multiplication_11))

multiplication_12 = Multiplication(A=直径_2, B=5)

Z_5 = UnitZ(Factor=multiplication_12)
extr_2 = Extrude(Base=move_12.Geometry, Direction=Z_5)
cap_2 = CapHoles(Brep=[extr_2, cyl_2])
merge_10 = Merge(Data1=cap_2, Data2=box_2)
flatten_6 = FlattenTree(Tree=merge_10, Path="{0}")
move_14 = Move(Geometry=flatten_6, Motion=Z_4)  # -> Geometry, Transform

box_3 = DomainBox(Base=PlaneXY(0, 0, 0), X=dom_4, Y=dom_4, Z=multiplication_11)
merge_11 = Merge(Data1=cap_2, Data2=box_3)
flatten_7 = FlattenTree(Tree=merge_11, Path="{0}")
move_15 = Move(Geometry=flatten_7, Motion=Z_4)  # -> Geometry, Transform
entwine_4 = Entwine(Branch00=move_14.Geometry, Branch01=move_15.Geometry, FlattenInputs=True)

# ---- group: 选单体
板埋or槽埋or板槽埋 = StreamFilter(Gate=list, Stream0=entwine_4, Stream1=entwine_2, Stream2=entwine_3)

# ----
# 三视图
# hidden lines of top+pers view
# move to center
# 如果无法完整的生成埋件的三视图，
# 建议选择埋件的3D在Rhino中将
# Top/Perspective/Front/Right 试图缩放至合适大小后重新运行
panel_34 = Panel("""Top
Perspective
Front
Right""")
m2d_rhino = Make2DRhinoView(Name=panel_34, Clip=True)
make2d = Make2D(Geometry=板埋or槽埋or板槽埋, View=m2d_rhino, TangentEdges=False, TangentSeams=False, AutoComputeMake2D=False)  # -> VisibleCurves, VisibleIndex, VisibleType, HiddenCurves, HiddenIndex, HiddenType
bang_2 = ExplodeTree(Data=make2d.VisibleCurves)  # -> Branch0, Branch1, Branch2, Branch3, Branch4, Branch5, Branch6, Branch7
bang_3 = ExplodeTree(Data=make2d.VisibleCurves)  # -> Branch0, Branch1, Branch2, Branch3, Branch4, Branch5, Branch6, Branch7
divdist = DivideDistance(Curve=make2d.HiddenCurves, Distance=Slider(1, range=0..10))  # -> Points, Tangents, Parameters
graft_2 = GraftTree(Tree=make2d.HiddenCurves, IncludeEmptyLists=True, IncludeNullItems=True)
shatter = Shatter(Curve=graft_2, Parameters=divdist.Parameters)
dispatch_14 = Dispatch(List=shatter, DispatchPattern=[True, False])  # -> ListA, ListB
crv_40 = Curve(dispatch_14.ListA)
pshift = ShiftPaths(Data=crv_40, Offset=-1)
pshift_2 = ShiftPaths(Data=pshift, Offset=-1)
bang_4 = ExplodeTree(Data=pshift_2)  # -> Branch0, Branch1, Branch2, Branch3, Branch4, Branch5, Branch6, Branch7
bang_5 = ExplodeTree(Data=pshift_2)  # -> Branch0, Branch1, Branch2, Branch3, Branch4, Branch5, Branch6, Branch7
entwine_5 = Entwine(Branch00=bang_5.Branch4, Branch01=bang_3.Branch4, FlattenInputs=True)  # -> flatten(Result)
entwine_6 = Entwine(Branch00=bang_5.Branch5, Branch01=bang_3.Branch5, FlattenInputs=True)  # -> flatten(Result)
entwine_7 = Entwine(Branch00=bang_4.Branch0, Branch01=bang_2.Branch0, FlattenInputs=True)  # -> flatten(Result)
entwine_8 = Entwine(Branch00=bang_4.Branch1, Branch01=bang_2.Branch1, FlattenInputs=True)  # -> flatten(Result)
entwine_9 = Entwine(Branch00=entwine_7, Branch01=entwine_8, Branch02=bang_2.Branch2, Branch03=bang_2.Branch3, FlattenInputs=True)
entwine_10 = Entwine(Branch00=entwine_5, Branch01=entwine_6, Branch02=bang_3.Branch6, Branch03=bang_3.Branch7, FlattenInputs=True)
group = Group(Objects=entwine_9)
group_2 = Group(Objects=entwine_10)
entwine_11 = Entwine(Branch00=group, Branch01=group_2, FlattenInputs=True)
pshift_3 = ShiftPaths(Data=entwine_11, Offset=-1)
pshift_4 = ShiftPaths(Data=entwine_11, Offset=-1)
number_slider_21 = Slider(2, range=0..10)
boxprop = BoxProperties(Box=pshift_3)  # -> Center, Diagonal, Area, Volume, Degeneracy
pt_28 = Point(Point(957.9296072, 367.7685097, 0))
pt_29 = Point("0,0,0")
recgrid_3 = Rectangular(
    Plane=pt_28,
    SizeX=Slider(12, range=1..20, expression="X*50"),
    SizeY=Slider(10, range=1..20, expression="X*50"),
    ExtentX=number_slider_21,
    ExtentY=number_slider_21)  # -> Cells, Points
vec2pt = Vector2Pt(PointA=boxprop.Center, PointB=pt_29, Unitize=False)  # -> Vector, Length
flatten_8 = FlattenTree(Tree=recgrid_3.Points, Path="{0}")
move_16 = Move(Geometry=pshift_4, Motion=vec2pt.Vector)  # -> flatten(Geometry), Transform
orient_5 = Orient(Geometry=flatten(move_16.Geometry), Source=PlaneXY(0, 0, 0), Target=flatten_8)  # -> Geometry, Transform
cull_i_6 = CullIndex(List=orient_5.Geometry, Indices="-1", Wrap=True)
split = SplitList(List=cull_i_6, Index="4")  # -> ListA, ListB
data_22 = Data(split.ListA)
data_23 = Data(split.ListB)
entwine_12 = Entwine(Branch00=data_22, Branch01=data_23, FlattenInputs=True)
geo_4 = Geometry(entwine_12)

# ---- group: 单体定Top/Side
item_21 = ListItem(List=geo_4, Index=2, Wrap=True)
item_22 = ListItem(List=geo_4, Index=Slider(0, range=0..10), Wrap=True)
cluster = Cluster(G=item_22)
cluster_2 = Cluster(G=item_21)

# ---- group: 单体定Top/Side / Top/Side
filter_14 = StreamFilter(Gate=list_2, Stream0=cluster, Stream1=cluster_2)

# ---- group: 单体定Top/Side / Monomer + Top/Side
filter_15 = StreamFilter(Gate=list, Stream0=filter_14, Stream1=filter_14, Stream2=filter_14)  # -> flatten(Stream)

# ---- group: Block
# 自定义块所在图层
# 自定义块所在图层颜色
# 自定义块名称
panel_35 = Panel("Embeded::Embeded")
layer_2 = DefineLayer(Name=panel_35, Color=ColourSwatch(SwatchColor=RGB(255, 0, 0)))
attributes = DefineObjectAttributes(Layer=layer_2)
block = DefineBlock(Geometry=filter_14, Attributes=attributes, BlockName="Steel Plate", BasePlane=PlaneXY(0, 0, 0))

# ---- group: 正常+阳角+阴角区分
cull_i_7 = CullIndex(List=item_2, Indices=cp.CPIndex, Wrap=True)
crv_41 = Curve(offset)
crv_42 = Curve(flip.Curve)
explode_5 = Explode(Curve=crv_41, Recursive=True)  # -> Segments, Vertices
explode_6 = Explode(Curve=crv_42, Recursive=True)  # -> Segments, Vertices

# ---- group: 阴角定位-细化
item_23 = ListItem(List=item, Index=cp.CPIndex, Wrap=True)

# ----
clscrv = CloseCurve(Curve=crv_18, CloseType=0, Bulge=0.5, Tolerance=0)  # -> Closed, R
crv_43 = Curve(crv_15)
disc_5 = Discontinuity(Curve=graft(crv_43), Level=1)  # -> Points, Parameters
crv_cp_3 = CurveClosestPoint(Point=disc_5.Points, Curve=graft(crv_43))  # -> Point, Parameter, Distance
eval_3 = EvaluateCurve(Curve=graft(crv_43), Parameter=crv_cp_3.Parameter)  # -> flatten(Point), Tangent, flatten(Angle)
deg_2 = Degrees(Radians=eval_3.Angle)
offset_10 = OffsetCurve(Curve=clscrv.Closed, Distance=expr("-X", Slider(300, range=0..1000)), Corners=1)
panel_36 = Panel(deg_2)
larger_4 = LargerThan(FirstNumber=deg_2, SecondNumber=Slider(60, range=0..100))  # -> LargerThan, OrEqualTo
disc_6 = Discontinuity(Curve=offset_10, Level=1)  # -> flatten(Points), Parameters
dispatch_15 = Dispatch(List=eval_3.Point, DispatchPattern=larger_4.LargerThan)  # -> ListA, ListB
data_24 = Data(dispatch_15.ListA)
pull_6 = PullPoint(Point=data_24, Geometry=flatten(offset_10), ClosestOnly=True)  # -> ClosestPoint, Distance
pull_7 = PullPoint(Point=flatten(pln_6), Geometry=crv_43, ClosestOnly=True)  # -> ClosestPoint, Distance
testpoint_2 = TestPoint(archPoint=pull_6.ClosestPoint, crvPoint=disc_6.Points)  # -> out, specialPt; inputs archPoint: list of Point3d, crvPoint: list of Point3d; same code as testpoint
pull_8 = PullPoint(Point=pull_7.ClosestPoint, Geometry=data_24, ClosestOnly=True)  # -> ClosestPoint, Distance
flatten_9 = FlattenTree(Tree=data_16, Path="{0}")
sort_7 = SortList(Keys=pull_8.Distance, ValuesA=flatten_9)  # -> Keys, ValuesA
# 找阴阳角所在corners
# 第一层
# 
# Block(location point) + Smooth Curves(architecture line)
# 
# For Wrong Plane
panel_37 = Panel(sort_7.Keys)
smaller_3 = SmallerThan(FirstNumber=sort_7.Keys, SecondNumber=Slider(100, range=0..100))  # -> SmallerThan, OrEqualTo
dispatch_16 = Dispatch(List=sort_7.ValuesA, DispatchPattern=smaller_3.SmallerThan)  # -> ListA, ListB
data_25 = Data(dispatch_16.ListA)
deblock_6 = DeconstructBlock(Block=data_25)  # -> Name, Plane, Geometry
# 第二层-阴阳角
# 第二层-大面定位
deplane_10 = DeconstructPlane(Plane=deblock_6.Plane)  # -> Origin, XAxis, YAxis, ZAxis
pt_30 = Point(data_24)
pull_9 = PullPoint(Point=deplane_10.Origin, Geometry=pt_30, ClosestOnly=True)  # -> ClosestPoint, Distance
cir = Circle(Plane=pull_9.ClosestPoint, Radius=Slider(300, range=0..1000))
crv_44 = Curve(crv_43)
amp_6 = Amplitude(Vector=deplane_10.YAxis, Amplitude=Slider(200, range=0..1000))
ccx_5 = CurveCurve(CurveA=cir, CurveB=crv_44)  # -> Points, ParamsA, ParamsB
move_17 = Move(Geometry=pull_9.ClosestPoint, Motion=amp_6)  # -> Geometry, Transform
item_24 = ListItem(List=ccx_5.Points, Index=0, Wrap=True)
clean = CleanTree(RemoveNulls=True, RemoveInvalid=True, RemoveEmpty=Toggle(True), Tree=item_24)
ln_9 = Line(StartPoint=pull_9.ClosestPoint, EndPoint=clean)
ln_10 = Line(StartPoint=pull_9.ClosestPoint, EndPoint=move_17.Geometry)
angle = Angle(VectorA=ln_10, VectorB=ln_9)  # -> Angle, Reflex
deg_3 = Degrees(Radians=angle.Angle)
flatten_10 = FlattenTree(Tree=deg_3, Path="{0}")
# SmoothCurve-阴角&阳角
# SmoothCurve-阴角&阳角
panel_38 = Panel(flatten_10)
c_script = CSharpScript(angle=flatten_10, minus=Slider(80, range=0..100))  # -> out, results; inputs angle: list of Double, minus: Double
# ---------- c_script: C# ----------
    List<double> MyAngle = new List<double>();
    for(int i = 0; i < angle.Count; i++){
      if (angle[i] > minus){
        angleEach = angle[i] - 90;
        Print("!!!!!!!!");
        MyAngle.Add(angleEach);
      }
      else{
        angleEach = angle[i];
        Print("00000");
        MyAngle.Add(angleEach);
      }

    }

    results = MyAngle;
# ---------- c_script: C# additional code ----------
  double angleEach = 0;
# ---------- end c_script ----------
larger_5 = LargerThan(FirstNumber=c_script.results, SecondNumber=Slider(30, range=0..100))  # -> LargerThan, OrEqualTo
# remove duplicate block and reconstruct plane
panel_39 = Panel(c_script.results)
dispatch_17 = Dispatch(List=flatten(data_25), DispatchPattern=flatten(larger_5.LargerThan))  # -> ListA, ListB
data_26 = Data(dispatch_17.ListA)
deblock_7 = DeconstructBlock(Block=data_26)  # -> Name, Plane, Geometry
pln_13 = Plane(flatten(pln_6))
deplane_11 = DeconstructPlane(Plane=flatten(deblock_7.Plane))  # -> Origin, XAxis, YAxis, ZAxis
deplane_12 = DeconstructPlane(Plane=pln_13)  # -> Origin, XAxis, YAxis, ZAxis
testpoint_3 = TestPoint(archPoint=deplane_12.Origin, crvPoint=deplane_11.Origin)  # -> out, specialPt; inputs archPoint: list of Point3d, crvPoint: list of Point3d; same code as testpoint
cull_i_8 = CullIndex(List=pln_13, Indices=testpoint_3.specialPt, Wrap=True)
pln_14 = Plane(deblock_7.Plane)
crv_45 = Curve(crv_15)
pln_15 = Plane(cull_i_8)
data_27 = Data(flatten(pln_15))
deplane_13 = DeconstructPlane(Plane=data_27)  # -> Origin, XAxis, YAxis, ZAxis
amp_7 = Amplitude(Vector=deplane_13.YAxis, Amplitude=Slider(300, range=0..1000))
move_18 = Move(Geometry=deplane_13.Origin, Motion=amp_7)  # -> Geometry, Transform
ln_11 = Line(StartPoint=deplane_13.Origin, EndPoint=move_18.Geometry)
midpt_10 = CurveMiddle(Curve=ln_11)
scale_6 = Scale(Geometry=ln_11, Center=midpt_10, Factor=Slider(4.7, range=0..10))  # -> Geometry, Transform
ccx_6 = CurveCurve(CurveA=graft(scale_6.Geometry), CurveB=crv_45)  # -> flatten(Points), ParamsA, ParamsB
move2pt_6 = MoveToPoint(Geometry=data_27, PointA=deplane_13.Origin, PointB=ccx_6.Points)  # -> Moved, Vector, Transform

# ----
# 第一层
# 
# Angular Curves(architecture line)
number_slider_22 = Slider(84, range=0..1000)
crv_46 = Curve(crv_19)
crv_47 = Curve(clscrv.Closed)
offset_11 = OffsetCurve(Curve=crv_47, Distance=expr("-x", number_slider_22), Corners=1)  # -> flatten(Curve)
disc_7 = Discontinuity(Curve=crv_46, Level=1)  # -> Points, Parameters
pull_10 = PullPoint(Point=disc_7.Points, Geometry=offset_11, ClosestOnly=True)  # -> ClosestPoint, Distance
disc_8 = Discontinuity(Curve=offset_11, Level=1)  # -> Points, Parameters
pull_11 = PullPoint(Point=flatten(pull_10.ClosestPoint), Geometry=flatten(disc_8.Points), ClosestOnly=True)  # -> ClosestPoint, Distance
check_same_points = CheckSamePoints(archPoint=flatten(pull_10.ClosestPoint), crvPoint=flatten(pull_11.ClosestPoint))  # -> out, specialPt; inputs archPoint: list of Point3d, crvPoint: list of Point3d; same code as testpoint
cull_i_9 = CullIndex(List=flatten(disc_7.Points), Indices=check_same_points.specialPt, Wrap=True)
end_4 = EndPoints(Curve=crv_46)  # -> Start, End
merge_12 = Merge(Data1=end_4.Start, Data2=end_4.End, Data3=cull_i_9)
flatten_11 = FlattenTree(Tree=disc_7.Points, Path="{0}")
check_same_points_2 = CheckSamePoints(archPoint=flatten(flatten_11), crvPoint=flatten(merge_12))  # -> out, specialPt; inputs archPoint: list of Point3d, crvPoint: list of Point3d; same code as testpoint
cull_i_10 = CullIndex(List=flatten(flatten_11), Indices=check_same_points_2.specialPt, Wrap=True)
pull_12 = PullPoint(Point=cull_i_10, Geometry=offset_11, ClosestOnly=True)  # -> ClosestPoint, Distance
ln_12 = Line(StartPoint=cull_i_10, EndPoint=pull_12.ClosestPoint)
rotate_5 = Rotate(Geometry=ln_12, Angle="Pi", Plane=cull_i_10)  # -> Geometry, Transform
# 阳角
# 阴角
rotate_6 = Rotate(Geometry=ln_12, Angle=1.570796327, Plane=cull_i_10)  # -> Geometry, Transform
# SmoothCurve-阳角
# SmoothCurve-阴角
# SmoothCurve-阳角
# SmoothCurve-阴角
# SmoothCurve-正常
# Angular Curve - All
# Special Curve(with location)- All
# Curve for this project only - All
pl_4 = ConstructPlane(Origin=cull_i_10, XAxis=rotate_5.Geometry, YAxis=rotate_6.Geometry)

# ----
# 第一层
# 
# Angular Curves(architecture line)
crv_48 = Curve(crv_17)
crv_49 = Curve(clscrv.Closed)
offset_12 = OffsetCurve(Curve=crv_49, Distance=expr("-x", Slider(84, range=0..1000)), Corners=1)  # -> flatten(Curve)
disc_9 = Discontinuity(Curve=crv_48, Level=1)  # -> Points, Parameters
pull_13 = PullPoint(Point=disc_9.Points, Geometry=offset_12, ClosestOnly=True)  # -> ClosestPoint, Distance
disc_10 = Discontinuity(Curve=offset_12, Level=1)  # -> Points, Parameters
pull_14 = PullPoint(Point=flatten(pull_13.ClosestPoint), Geometry=flatten(disc_10.Points), ClosestOnly=True)  # -> ClosestPoint, Distance
check_same_points_3 = CheckSamePoints(archPoint=flatten(pull_13.ClosestPoint), crvPoint=flatten(pull_14.ClosestPoint))  # -> out, specialPt; inputs archPoint: list of Point3d, crvPoint: list of Point3d; same code as testpoint
cull_i_11 = CullIndex(List=flatten(disc_9.Points), Indices=check_same_points_3.specialPt, Wrap=True)
end_5 = EndPoints(Curve=crv_48)  # -> Start, End
merge_13 = Merge(Data1=end_5.Start, Data2=end_5.End, Data3=cull_i_11)
flatten_12 = FlattenTree(Tree=disc_9.Points, Path="{0}")
check_same_points_4 = CheckSamePoints(archPoint=flatten(flatten_12), crvPoint=flatten(merge_13))  # -> out, specialPt; inputs archPoint: list of Point3d, crvPoint: list of Point3d; same code as testpoint
cull_i_12 = CullIndex(List=flatten(flatten_12), Indices=check_same_points_4.specialPt, Wrap=True)
pull_15 = PullPoint(Point=cull_i_12, Geometry=offset_12, ClosestOnly=True)  # -> ClosestPoint, Distance
ln_13 = Line(StartPoint=cull_i_12, EndPoint=pull_15.ClosestPoint)
rotate_7 = Rotate(Geometry=ln_13, Angle="Pi", Plane=cull_i_12)  # -> Geometry, Transform
rotate_8 = Rotate(Geometry=rotate_7.Geometry, Angle=-1.570796327, Plane=cull_i_12)  # -> Geometry, Transform
pl_5 = ConstructPlane(Origin=cull_i_12, XAxis=rotate_7.Geometry, YAxis=rotate_8.Geometry)

# ----
# 阳角
item_25 = ListItem(List=data_24, Index=testpoint_2.specialPt, Wrap=True)

# ----
# 第一层
# 
# Curves(location point)+ Smooth Curves(architecture line)
# remove duplicate curves
geo_5 = Geometry(project_10.Geometry)
boundary_3 = BoundarySurfaces(Edges=geo_5)
area_10 = Area(Geometry=boundary_3)  # -> Area, Centroid
cullduppoints_4 = RemoveDuplicatePoints(InputPoints=area_10.Centroid, Tolerance=Slider(0.1, range=0..0.1))  # -> OutputPoints, FirstPointIndexes
null_5 = NullItem(Item=cullduppoints_4.FirstPointIndexes)  # -> NullFlags, InvalidFlags, Description
dispatch_18 = Dispatch(List=boundary_3, DispatchPattern=null_5.NullFlags)  # -> ListA, ListB
geo_6 = Geometry(dispatch_18.ListA)
crv_50 = Curve(crv_15)
area_11 = Area(Geometry=geo_6)  # -> Area, Centroid
pull_16 = PullPoint(Point=area_11.Centroid, Geometry=crv_50, ClosestOnly=True)  # -> ClosestPoint, Distance
# 转角点
dist_3 = Distance(PointA=pull_16.ClosestPoint, PointB=data_24)
sort_8 = SortList(Keys=dist_3)  # -> Keys, ValuesA
panel_40 = Panel(sort_8.Keys)
smaller_4 = SmallerThan(FirstNumber=dist_3, SecondNumber=Slider(200, range=0..1000))  # -> SmallerThan, OrEqualTo
dispatch_19 = Dispatch(List=geo_6, DispatchPattern=smaller_4.SmallerThan)  # -> ListA, ListB
data_28 = Data(dispatch_19.ListA)
data_29 = Data(dispatch_19.ListB)
explode_7 = Explode(Curve=data_28, Recursive=True)  # -> Segments, Vertices
explode_8 = Explode(Curve=data_29, Recursive=True)  # -> Segments, Vertices
len_4 = Length(Curve=explode_7.Segments)
len_5 = Length(Curve=explode_8.Segments)
sort_9 = SortList(Keys=reverse(len_4), ValuesA=explode_7.Segments)  # -> Keys, ValuesA
sort_10 = SortList(Keys=reverse(len_5), ValuesA=explode_8.Segments)  # -> Keys, ValuesA
item_26 = ListItem(List=sort_9.ValuesA, Index=0, Wrap=True)  # -> flatten(Item)
area_12 = Area(Geometry=data_28)  # -> Area, Centroid
item_27 = ListItem(List=sort_10.ValuesA, Index=0, Wrap=True)  # -> flatten(Item)
area_13 = Area(Geometry=data_29)  # -> Area, Centroid
midpt_11 = CurveMiddle(Curve=item_26)
midpt_12 = CurveMiddle(Curve=item_27)
move2pt_7 = MoveToPoint(Geometry=item_26, PointA=midpt_11, PointB=area_12.Centroid)  # -> Moved, Vector, Transform
move2pt_8 = MoveToPoint(Geometry=item_27, PointA=midpt_12, PointB=area_13.Centroid)  # -> Moved, Vector, Transform
end_6 = EndPoints(Curve=move2pt_7.Moved)  # -> Start, End
end_7 = EndPoints(Curve=move2pt_8.Moved)  # -> Start, End
ln_14 = Line(StartPoint=end_6.Start, EndPoint=end_6.End)
pull_17 = PullPoint(Point=end_7.Start, Geometry=crv_50, ClosestOnly=True)  # -> ClosestPoint, Distance
neg_4 = Negative(Value="0.5 * Pi")
neg_5 = Negative(Value="1.5 * Pi")
crv_cp_4 = CurveClosestPoint(Point=graft(pull_17.ClosestPoint), Curve=crv_50)  # -> Point, Parameter, Distance
filter_16 = StreamFilter(Gate=Toggle(True), Stream0="0.5 * Pi", Stream1=neg_4)
filter_17 = StreamFilter(Gate=Toggle(True), Stream0="1.5 * Pi", Stream1=neg_5)
xy_27 = XYPlane(Origin=end_6.End)
eval_4 = EvaluateCurve(Curve=crv_50, Parameter=crv_cp_4.Parameter)  # -> Point, Tangent, Angle
rotate_9 = Rotate(Geometry=ln_14, Angle=filter_16, Plane=xy_27)  # -> Geometry, Transform
# 阳角
pull_18 = PullPoint(Point=eval_4.Point, Geometry=pull_17.ClosestPoint, ClosestOnly=True)  # -> ClosestPoint, Distance
pl_6 = ConstructPlane(Origin=end_6.End, XAxis=rotate_9.Geometry, YAxis=ln_14)
sort_11 = SortList(Keys=pull_18.Distance, ValuesA=eval_4.Point)  # -> Keys, ValuesA
# 阴角
sort_12 = SortList(Keys=pull_18.Distance, ValuesA=eval_4.Tangent)  # -> Keys, ValuesA
dist_4 = Distance(PointA=graft(end_6.End), PointB=item_25)
item_28 = ListItem(List=sort_12.ValuesA, Index="0", Wrap=True)
sort_13 = SortList(Keys=dist_4)  # -> Keys, ValuesA
item_29 = ListItem(List=sort_11.ValuesA, Index="0", Wrap=True)
item_30 = ListItem(List=sort_13.Keys, Index=0, Wrap=True)
smaller_5 = SmallerThan(FirstNumber=item_30, SecondNumber=Slider(100, range=0..300))  # -> SmallerThan, OrEqualTo
flatten_13 = FlattenTree(Tree=item_30, Path="{0}")
amp_8 = Amplitude(Vector=item_28, Amplitude=Slider(100, range=0..100))
dispatch_20 = Dispatch(List=graft(pl_6), DispatchPattern=smaller_5.SmallerThan)  # -> ListA, ListB
panel_41 = Panel(flatten_13)
move_19 = Move(Geometry=item_29, Motion=amp_8)  # -> Geometry, Transform
xy_28 = XYPlane(Origin=item_29)
rotate_10 = Rotate(Geometry=move_19.Geometry, Angle="1 * Pi", Plane=xy_28)  # -> Geometry, Transform
ln_15 = Line(StartPoint=item_29, EndPoint=rotate_10.Geometry)
crv_51 = Curve(crv_15)
rotate_11 = Rotate(Geometry=ln_15, Angle=filter_17, Plane=xy_28)  # -> Geometry, Transform
data_30 = Data(flatten(dispatch_20.ListA))
data_31 = Data(flatten(dispatch_20.ListB))
deplane_14 = DeconstructPlane(Plane=data_30)  # -> Origin, XAxis, YAxis, ZAxis
deplane_15 = DeconstructPlane(Plane=data_31)  # -> Origin, XAxis, YAxis, ZAxis
amp_9 = Amplitude(Vector=deplane_14.YAxis, Amplitude=Slider(300, range=0..1000))
amp_10 = Amplitude(Vector=deplane_15.YAxis, Amplitude=Slider(300, range=0..1000))
move_20 = Move(Geometry=deplane_14.Origin, Motion=amp_9)  # -> Geometry, Transform
move_21 = Move(Geometry=deplane_15.Origin, Motion=amp_10)  # -> Geometry, Transform
ln_16 = Line(StartPoint=deplane_14.Origin, EndPoint=move_20.Geometry)
ln_17 = Line(StartPoint=deplane_15.Origin, EndPoint=move_21.Geometry)
midpt_13 = CurveMiddle(Curve=ln_16)
midpt_14 = CurveMiddle(Curve=ln_17)
scale_7 = Scale(Geometry=ln_16, Center=midpt_13, Factor=Slider(1.5, range=0..10))  # -> Geometry, Transform
scale_8 = Scale(Geometry=ln_17, Center=midpt_14, Factor=Slider(1.5, range=0..10))  # -> Geometry, Transform
ccx_7 = CurveCurve(CurveA=graft(scale_8.Geometry), CurveB=crv_51)  # -> flatten(Points), ParamsA, ParamsB
ccx_8 = CurveCurve(CurveA=graft(scale_7.Geometry), CurveB=crv_51)  # -> flatten(Points), ParamsA, ParamsB
# SmoothCurve-正常
move2pt_9 = MoveToPoint(Geometry=data_30, PointA=deplane_14.Origin, PointB=ccx_8.Points)  # -> Moved, Vector, Transform
# SmoothCurve-阳角
move2pt_10 = MoveToPoint(Geometry=data_31, PointA=deplane_15.Origin, PointB=ccx_7.Points)  # -> Moved, Vector, Transform
# SmoothCurve-阴角
pl_7 = ConstructPlane(Origin=move_19.Geometry, XAxis=ln_15, YAxis=rotate_11.Geometry)

# ----
# 阴角
cull_i_13 = CullIndex(List=data_24, Indices=testpoint_2.specialPt, Wrap=True)

dist_5 = Distance(PointA=graft(deplane_11.Origin), PointB=item_25)
sort_14 = SortList(Keys=dist_5)  # -> Keys, ValuesA
item_31 = ListItem(List=sort_14.Keys, Index=0, Wrap=True)
flatten_14 = FlattenTree(Tree=item_31, Path="{0}")
smaller_6 = SmallerThan(FirstNumber=item_31, SecondNumber=Slider(100, range=0..300))  # -> SmallerThan, OrEqualTo
panel_42 = Panel(flatten_14)
dispatch_21 = Dispatch(List=graft(pln_14), DispatchPattern=smaller_6.SmallerThan)  # -> ListA, ListB
data_32 = Data(flatten(dispatch_21.ListA))
data_33 = Data(flatten(dispatch_21.ListB))
deplane_16 = DeconstructPlane(Plane=data_32)  # -> Origin, XAxis, YAxis, ZAxis
deplane_17 = DeconstructPlane(Plane=data_33)  # -> Origin, XAxis, YAxis, ZAxis
amp_11 = Amplitude(Vector=deplane_16.YAxis, Amplitude=Slider(300, range=0..1000))
amp_12 = Amplitude(Vector=deplane_17.YAxis, Amplitude=Slider(300, range=0..1000))
move_22 = Move(Geometry=deplane_16.Origin, Motion=amp_11)  # -> Geometry, Transform
move_23 = Move(Geometry=deplane_17.Origin, Motion=amp_12)  # -> Geometry, Transform
ln_18 = Line(StartPoint=deplane_16.Origin, EndPoint=move_22.Geometry)
ln_19 = Line(StartPoint=deplane_17.Origin, EndPoint=move_23.Geometry)
midpt_15 = CurveMiddle(Curve=ln_18)
midpt_16 = CurveMiddle(Curve=ln_19)
scale_9 = Scale(Geometry=ln_18, Center=midpt_15, Factor=Slider(1.5, range=0..10))  # -> Geometry, Transform
scale_10 = Scale(Geometry=ln_19, Center=midpt_16, Factor=Slider(1.5, range=0..10))  # -> Geometry, Transform
ccx_9 = CurveCurve(CurveA=graft(scale_9.Geometry), CurveB=crv_45)  # -> flatten(Points), ParamsA, ParamsB
ccx_10 = CurveCurve(CurveA=graft(scale_10.Geometry), CurveB=crv_45)  # -> flatten(Points), ParamsA, ParamsB
move2pt_11 = MoveToPoint(Geometry=data_32, PointA=deplane_16.Origin, PointB=ccx_9.Points)  # -> Moved, Vector, Transform
move2pt_12 = MoveToPoint(Geometry=data_33, PointA=deplane_17.Origin, PointB=ccx_10.Points)  # -> Moved, Vector, Transform

clscrv_2 = CloseCurve(Curve=crv_18, CloseType=0, Bulge=0.5, Tolerance=0)  # -> Closed, R
crv_52 = Curve(crv_15)
disc_11 = Discontinuity(Curve=graft(crv_52), Level=1)  # -> Points, Parameters
crv_cp_5 = CurveClosestPoint(Point=disc_11.Points, Curve=graft(crv_52))  # -> Point, Parameter, Distance
eval_5 = EvaluateCurve(Curve=graft(crv_52), Parameter=crv_cp_5.Parameter)  # -> flatten(Point), Tangent, flatten(Angle)
deg_4 = Degrees(Radians=eval_5.Angle)
offset_13 = OffsetCurve(Curve=clscrv_2.Closed, Distance=expr("-X", Slider(300, range=0..1000)), Corners=1)
panel_43 = Panel(deg_4)
larger_6 = LargerThan(FirstNumber=deg_4, SecondNumber=Slider(60, range=0..100))  # -> LargerThan, OrEqualTo
disc_12 = Discontinuity(Curve=offset_13, Level=1)  # -> flatten(Points), Parameters
dispatch_22 = Dispatch(List=eval_5.Point, DispatchPattern=larger_6.LargerThan)  # -> ListA, ListB
data_34 = Data(dispatch_22.ListA)
pull_19 = PullPoint(Point=data_34, Geometry=flatten(offset_13), ClosestOnly=True)  # -> ClosestPoint, Distance
testpoint_4 = TestPoint(archPoint=pull_19.ClosestPoint, crvPoint=disc_12.Points)  # -> out, specialPt; inputs archPoint: list of Point3d, crvPoint: list of Point3d; same code as testpoint
pull_20 = PullPoint(Point=flatten(pln_12), Geometry=crv_52, ClosestOnly=True)  # -> ClosestPoint, Distance
pull_21 = PullPoint(Point=pull_20.ClosestPoint, Geometry=data_34, ClosestOnly=True)  # -> ClosestPoint, Distance
flatten_15 = FlattenTree(Tree=data_21, Path="{0}")
sort_15 = SortList(Keys=pull_21.Distance, ValuesA=flatten_15)  # -> Keys, ValuesA
panel_44 = Panel(sort_15.Keys)
smaller_7 = SmallerThan(FirstNumber=sort_15.Keys, SecondNumber=Slider(100, range=0..100))  # -> SmallerThan, OrEqualTo
dispatch_23 = Dispatch(List=sort_15.ValuesA, DispatchPattern=smaller_7.SmallerThan)  # -> ListA, ListB
data_35 = Data(dispatch_23.ListA)
deblock_8 = DeconstructBlock(Block=data_35)  # -> Name, Plane, Geometry
deplane_18 = DeconstructPlane(Plane=deblock_8.Plane)  # -> Origin, XAxis, YAxis, ZAxis
pt_31 = Point(data_34)
pull_22 = PullPoint(Point=deplane_18.Origin, Geometry=pt_31, ClosestOnly=True)  # -> ClosestPoint, Distance
cir_2 = Circle(Plane=pull_22.ClosestPoint, Radius=Slider(300, range=0..1000))
crv_53 = Curve(crv_52)
amp_13 = Amplitude(Vector=deplane_18.YAxis, Amplitude=Slider(200, range=0..1000))
ccx_11 = CurveCurve(CurveA=cir_2, CurveB=crv_53)  # -> Points, ParamsA, ParamsB
move_24 = Move(Geometry=pull_22.ClosestPoint, Motion=amp_13)  # -> Geometry, Transform
item_32 = ListItem(List=ccx_11.Points, Index=0, Wrap=True)
clean_2 = CleanTree(RemoveNulls=True, RemoveInvalid=True, RemoveEmpty=Toggle(True), Tree=item_32)
item_33 = ListItem(List=data_34, Index=testpoint_4.specialPt, Wrap=True)
cull_i_14 = CullIndex(List=data_34, Indices=testpoint_4.specialPt, Wrap=True)
ln_20 = Line(StartPoint=pull_22.ClosestPoint, EndPoint=clean_2)
ln_21 = Line(StartPoint=pull_22.ClosestPoint, EndPoint=move_24.Geometry)
angle_2 = Angle(VectorA=ln_21, VectorB=ln_20)  # -> Angle, Reflex
deg_5 = Degrees(Radians=angle_2.Angle)
flatten_16 = FlattenTree(Tree=deg_5, Path="{0}")
panel_45 = Panel(flatten_16)
c_script_2 = CSharpScript(angle=flatten_16, minus=Slider(80, range=0..100))  # -> out, results; inputs angle: list of Double, minus: Double; same code as c_script
larger_7 = LargerThan(FirstNumber=c_script_2.results, SecondNumber=Slider(30, range=0..100))  # -> LargerThan, OrEqualTo
panel_46 = Panel(c_script_2.results)
dispatch_24 = Dispatch(List=flatten(data_35), DispatchPattern=flatten(larger_7.LargerThan))  # -> ListA, ListB
data_36 = Data(dispatch_24.ListA)
deblock_9 = DeconstructBlock(Block=data_36)  # -> Name, Plane, Geometry
pln_16 = Plane(flatten(pln_12))
deplane_19 = DeconstructPlane(Plane=flatten(deblock_9.Plane))  # -> Origin, XAxis, YAxis, ZAxis
deplane_20 = DeconstructPlane(Plane=pln_16)  # -> Origin, XAxis, YAxis, ZAxis
testpoint_5 = TestPoint(archPoint=deplane_20.Origin, crvPoint=deplane_19.Origin)  # -> out, specialPt; inputs archPoint: list of Point3d, crvPoint: list of Point3d; same code as testpoint
cull_i_15 = CullIndex(List=pln_16, Indices=testpoint_5.specialPt, Wrap=True)
pln_17 = Plane(deblock_9.Plane)
dist_6 = Distance(PointA=graft(deplane_19.Origin), PointB=item_33)
sort_16 = SortList(Keys=dist_6)  # -> Keys, ValuesA
item_34 = ListItem(List=sort_16.Keys, Index=0, Wrap=True)
flatten_17 = FlattenTree(Tree=item_34, Path="{0}")
smaller_8 = SmallerThan(FirstNumber=item_34, SecondNumber=Slider(100, range=0..300))  # -> SmallerThan, OrEqualTo
panel_47 = Panel(flatten_17)
dispatch_25 = Dispatch(List=graft(pln_17), DispatchPattern=smaller_8.SmallerThan)  # -> ListA, ListB
crv_54 = Curve(crv_15)
pln_18 = Plane(cull_i_15)

data_37 = Data(flatten(dispatch_25.ListA))
deplane_21 = DeconstructPlane(Plane=data_37)  # -> Origin, XAxis, YAxis, ZAxis
amp_14 = Amplitude(Vector=deplane_21.YAxis, Amplitude=Slider(300, range=0..1000))
move_25 = Move(Geometry=deplane_21.Origin, Motion=amp_14)  # -> Geometry, Transform
ln_22 = Line(StartPoint=deplane_21.Origin, EndPoint=move_25.Geometry)
midpt_17 = CurveMiddle(Curve=ln_22)
scale_11 = Scale(Geometry=ln_22, Center=midpt_17, Factor=Slider(1.5, range=0..10))  # -> Geometry, Transform
ccx_12 = CurveCurve(CurveA=graft(scale_11.Geometry), CurveB=crv_54)  # -> flatten(Points), ParamsA, ParamsB

data_38 = Data(flatten(dispatch_25.ListB))
deplane_22 = DeconstructPlane(Plane=data_38)  # -> Origin, XAxis, YAxis, ZAxis
amp_15 = Amplitude(Vector=deplane_22.YAxis, Amplitude=Slider(300, range=0..1000))
move_26 = Move(Geometry=deplane_22.Origin, Motion=amp_15)  # -> Geometry, Transform
ln_23 = Line(StartPoint=deplane_22.Origin, EndPoint=move_26.Geometry)
midpt_18 = CurveMiddle(Curve=ln_23)
scale_12 = Scale(Geometry=ln_23, Center=midpt_18, Factor=Slider(1.5, range=0..10))  # -> Geometry, Transform
ccx_13 = CurveCurve(CurveA=graft(scale_12.Geometry), CurveB=crv_54)  # -> flatten(Points), ParamsA, ParamsB

data_39 = Data(flatten(pln_18))
deplane_23 = DeconstructPlane(Plane=data_39)  # -> Origin, XAxis, YAxis, ZAxis
amp_16 = Amplitude(Vector=deplane_23.YAxis, Amplitude=Slider(300, range=0..1000))
move_27 = Move(Geometry=deplane_23.Origin, Motion=amp_16)  # -> Geometry, Transform
ln_24 = Line(StartPoint=deplane_23.Origin, EndPoint=move_27.Geometry)
midpt_19 = CurveMiddle(Curve=ln_24)
scale_13 = Scale(Geometry=ln_24, Center=midpt_19, Factor=Slider(4.7, range=0..10))  # -> Geometry, Transform
ccx_14 = CurveCurve(CurveA=graft(scale_13.Geometry), CurveB=crv_54)  # -> flatten(Points), ParamsA, ParamsB

move2pt_13 = MoveToPoint(Geometry=data_39, PointA=deplane_23.Origin, PointB=ccx_14.Points)  # -> Moved, Vector, Transform
move2pt_14 = MoveToPoint(Geometry=data_37, PointA=deplane_21.Origin, PointB=ccx_12.Points)  # -> Moved, Vector, Transform
move2pt_15 = MoveToPoint(Geometry=data_38, PointA=deplane_22.Origin, PointB=ccx_13.Points)  # -> Moved, Vector, Transform
xy_29 = XYPlane(Origin=move2pt_13.Moved)
xy_30 = XYPlane(Origin=move2pt_14.Moved)
xy_31 = XYPlane(Origin=move2pt_15.Moved)
rotate_12 = Rotate(Geometry=move2pt_13.Moved, Angle="Pi", Plane=xy_29)  # -> Geometry, Transform
rotate_13 = Rotate(Geometry=move2pt_14.Moved, Angle="Pi", Plane=xy_30)  # -> Geometry, Transform
rotate_14 = Rotate(Geometry=move2pt_15.Moved, Angle="Pi", Plane=xy_31)  # -> Geometry, Transform
filter_18 = StreamFilter(Gate=Toggle(True), Stream0=move2pt_13.Moved, Stream1=rotate_12.Geometry)
filter_19 = StreamFilter(Gate=Toggle(True), Stream0=move2pt_14.Moved, Stream1=rotate_13.Geometry)
filter_20 = StreamFilter(Gate=Toggle(True), Stream0=move2pt_15.Moved, Stream1=rotate_14.Geometry)

# ----
# SIte-所有的定位点
merge_14 = Merge(
    Data1=move2pt_6.Moved,
    Data2=move2pt_11.Moved,
    Data3=move2pt_12.Moved,
    Data4=filter_18,
    Data5=filter_19,
    Data6=filter_20,
    Data7=move2pt_9.Moved,
    Data8=move2pt_10.Moved,
    Data9=pl_7,
    Data10=pl_5,
    Data11=pl_3,
    Data12=pl_4)  # -> flatten(Result)

# ---- group: 大面
# 大面埋件布置
number_slider_23 = Slider(0.002, range=0..0.01)
filter_21 = StreamFilter(Gate=list_2, Stream0=expression_4, Stream1=number_slider_23)
filter_22 = StreamFilter(Gate=list, Stream0=filter_21, Stream1=expression_4, Stream2=filter_21)
offset_14 = OffsetCurve(Curve=offset, Distance=expr("-x", filter_22), Plane=PlaneXY(0, 0, 0), Corners=1)

# ---- group: 阴阳角区分 (continued)
crv_cp_6 = CurveClosestPoint(Point=item_16, Curve=offset_14)  # -> Point, Parameter, Distance
vec2pt_2 = Vector2Pt(PointA=crv_cp_6.Point, PointB=crv_cp_2.Point, Unitize=False)  # -> expr("-x", Vector), Length
angle_3 = Angle(VectorA=eval_2.Tangent, VectorB=vec2pt_2.Vector)  # -> Angle, Reflex
deg_6 = Degrees(Radians=angle_3.Angle)
smaller_9 = SmallerThan(FirstNumber=deg_6, SecondNumber=89)  # -> SmallerThan, OrEqualTo
dispatch_26 = Dispatch(List=item_16, DispatchPattern=smaller_9.SmallerThan)  # -> ListA, ListB

# ---- group: 正常+阳角+阴角区分 (continued)
data_40 = Data(dispatch_26.ListA)
data_41 = Data(dispatch_26.ListB)
pull_23 = PullPoint(Point=data_40, Geometry=crv_41, ClosestOnly=True)  # -> ClosestPoint, Distance
pull_24 = PullPoint(Point=data_41, Geometry=crv_42, ClosestOnly=True)  # -> ClosestPoint, Distance
c_script_3 = CSharpScript(archPoint=pull_23.ClosestPoint, crvPoint=explode_5.Vertices)  # -> out, specialPt; inputs archPoint: list of Point3d, crvPoint: list of Point3d; same code as testpoint
c_script_4 = CSharpScript(archPoint=pull_24.ClosestPoint, crvPoint=explode_6.Vertices)  # -> out, specialPt; inputs archPoint: list of Point3d, crvPoint: list of Point3d; same code as testpoint
cull_i_16 = CullIndex(List=data_40, Indices=c_script_3.specialPt, Wrap=True)

# ---- group: 阴角定位-细化 (continued)
dispatch_27 = Dispatch(List=item_23, DispatchPattern=smaller_9.SmallerThan)  # -> ListA, ListB
item_35 = ListItem(List=dispatch_27.ListB, Index=c_script_4.specialPt, Wrap=True)
join_4 = JoinCurves(Curves=item_35, Preserve=False)
explode_9 = Explode(Curve=join_4, Recursive=True)  # -> Segments, Vertices
crv_55 = Curve(simplify(explode_9.Segments))
len_6 = Length(Curve=crv_55)
sort_17 = SortList(Keys=len_6, ValuesA=crv_55)  # -> Keys, ValuesA
item_36 = ListItem(List=sort_17.ValuesA, Index=0, Wrap=True)  # -> Item2, Item1, Item
# 第一层
# 
# Block(location point) + Smooth Curves(architecture line)
# For Correct Plane
crv_56 = Curve([item_36.Item2, item_36.Item1])
disc_13 = Discontinuity(Curve=crv_56, Level=1)  # -> Points, Parameters
item_37 = ListItem(List=disc_13.Points, Index=0, Wrap=True)
# 求主体曲线转折点
pull_25 = PullPoint(Point=disc_13.Points, Geometry=pt_2, ClosestOnly=True)  # -> ClosestPoint, Distance
crv_cp_7 = CurveClosestPoint(Point=disc_13.Points, Curve=offset)  # -> Point, Parameter, Distance
sort_18 = SortList(Keys=pull_25.Distance, ValuesA=crv_cp_7.Point)  # -> Keys, ValuesA

# ---- group: 正常+阳角+阴角区分 / 正常-遗漏
cull_i_17 = CullIndex(List=data_41, Indices=c_script_4.specialPt, Wrap=True)

# ---- group: 正常+阳角+阴角区分 / 阴角定位点
item_38 = ListItem(List=data_41, Index=c_script_4.specialPt, Wrap=True)

# ---- group: 正常+阳角+阴角区分 / 正常定位点
merge_15 = Merge(Data1=cull_i_7, Data2=cull_i_17, Data3=cull_i_16)

# ---- group: 正常+阳角+阴角区分 / 阳角定位点
item_39 = ListItem(List=data_40, Index=c_script_3.specialPt, Wrap=True)

# ---- group: 阴角定位-细化 / 阴角-2点定位
# 找阴阳角所在corners
# remove duplicate block and reconstruct plane
item_40 = ListItem(List=sort_18.ValuesA, Index=0, Wrap=True)

# ----
# 阳角埋件布置
pt_32 = Point(item_39)
explode_10 = Explode(Curve=crv_22, Recursive=True)  # -> Segments, Vertices
cp_2 = ClosestPoint(Point=pt_32, Cloud=explode_10.Vertices)  # -> ClosestPoint, CPIndex, Distance
cir_3 = Circle(Plane=cp_2.ClosestPoint, Radius=Slider(150, range=0..1000))
pt_33 = Point(cp_2.ClosestPoint)
ccx_15 = CurveCurve(CurveA=cir_3, CurveB=offset)  # -> Points, ParamsA, ParamsB
item_41 = ListItem(List=ccx_15.Points, Index=0, Wrap=True)  # -> Item, Item1
ln_25 = Line(StartPoint=graft(pt_33), EndPoint=graft(item_41.Item))  # -> flatten(Line)
ln_26 = Line(StartPoint=graft(pt_33), EndPoint=graft(item_41.Item1))  # -> flatten(Line)
item_42 = ListItem(List=filter_15, Index="1", Wrap=True)
pl_8 = ConstructPlane(Origin=pt_33, XAxis=ln_25, YAxis=ln_26)
bbox_6 = BoundingBox(Content=graft(item_42), Plane=PlaneXY(0, 0, 0))  # -> Box, Box_2
srf = Surface(bbox_6.Box)
explode_11 = Explode(Curve=srf, Recursive=True)  # -> Segments, Vertices
item_43 = ListItem(List=explode_11.Vertices, Index=0, Wrap=True)  # -> Item, Item1, Item2
ln_27 = Line(StartPoint=graft(item_43.Item1), EndPoint=graft(item_43.Item2))
ln_28 = Line(StartPoint=graft(item_43.Item1), EndPoint=graft(item_43.Item))
ln_29 = Line(StartPoint=graft(item_43.Item1), EndPoint=graft(item_43.Item))
ln_30 = Line(StartPoint=graft(item_43.Item1), EndPoint=graft(item_43.Item2))
pl_9 = ConstructPlane(Origin=item_43.Item1, XAxis=ln_30, YAxis=ln_29)
pl_10 = ConstructPlane(Origin=item_43.Item1, XAxis=ln_28, YAxis=ln_27)
orient_6 = Orient(Geometry=item_42, Source=pl_10, Target=pl_8)  # -> Geometry, Transform
orient_7 = Orient(Geometry=item_42, Source=pl_9, Target=pl_8)  # -> Geometry, Transform
merge_16 = Merge(Data1=orient_6.Geometry, Data2=orient_7.Geometry)
filter_23 = StreamFilter(Gate=list_2, Stream0=orient_6.Geometry, Stream1=merge_16)
bbox_7 = BoundingBox(Content=filter_23, Plane=PlaneXY(0, 0, 0))  # -> Box, Box_2
entwine_13 = Entwine(Branch00=filter_23, Branch01=bbox_7.Box, FlattenInputs=True)
flip_3 = FlipMatrix(Data=entwine_13)
item_44 = ListItem(List=flip_3, Index=-1, Wrap=True)  # -> flatten(Item)
item_45 = ListItem(List=flip_3, Index="0", Wrap=True)  # -> flatten(Item)

# ---- group: 阴角
# 阴角埋件布置
# Rhino 文件中导入的块名
explode_12 = Explode(Curve=crv_22, Recursive=True)  # -> Segments, Vertices
cp_3 = ClosestPoint(Point=item_38, Cloud=explode_12.Vertices)  # -> ClosestPoint, CPIndex, Distance
pshift_5 = ShiftPaths(Data=item_40, Offset=-1)
crv_cp_8 = CurveClosestPoint(Point=pshift_5, Curve=offset_14)  # -> Point, Parameter, Distance
crv_cp_9 = CurveClosestPoint(Point=pshift_5, Curve=offset)  # -> Point, Parameter, Distance
vec2pt_3 = Vector2Pt(PointA=crv_cp_8.Point, PointB=crv_cp_9.Point, Unitize=False)  # -> expr("-x", Vector), Length
eval_6 = EvaluateCurve(Curve=offset, Parameter=crv_cp_9.Parameter)  # -> Point, Tangent, Angle
pl_11 = ConstructPlane(Origin=crv_cp_9.Point, XAxis=eval_6.Tangent, YAxis=vec2pt_3.Vector)
orient_8 = Orient(Geometry=block, Source=PlaneXY(0, 0, 0), Target=pl_11)  # -> Geometry, Transform

# ---- group: 大面 (continued)
crv_cp_10 = CurveClosestPoint(Point=merge_15, Curve=offset_14)  # -> Point, Parameter, Distance
crv_cp_11 = CurveClosestPoint(Point=merge_15, Curve=offset)  # -> Point, Parameter, Distance
vec2pt_4 = Vector2Pt(PointA=crv_cp_10.Point, PointB=crv_cp_11.Point, Unitize=False)  # -> expr("-x", Vector), Length
eval_7 = EvaluateCurve(Curve=offset, Parameter=crv_cp_11.Parameter)  # -> Point, Tangent, Angle
pl_12 = ConstructPlane(Origin=crv_cp_11.Point, XAxis=eval_7.Tangent, YAxis=vec2pt_4.Vector)
orient_9 = Orient(Geometry=block, Source=PlaneXY(0, 0, 0), Target=pl_12)  # -> flatten(Geometry), Transform

# ---- group: Datea / 2
lng_5 = ListLength(List=orient_9.Geometry)
division_10 = Division(A=lng_5, B=2)
split_2 = SplitList(List=orient_9.Geometry, Index=division_10)  # -> ListA, ListB
data_42 = Data(split_2.ListA)

# ----
bbox_8 = BoundingBox(Content=data_42, Plane=PlaneXY(0, 0, 0))  # -> Box, Box_2
entwine_14 = Entwine(Branch00=data_42, Branch01=bbox_8.Box, FlattenInputs=True)
flip_4 = FlipMatrix(Data=entwine_14)
item_46 = ListItem(List=flip_4, Index=-1, Wrap=True)  # -> flatten(Item)
item_47 = ListItem(List=flip_4, Index="0", Wrap=True)  # -> flatten(Item)
阴角 = Geometry(orient_8.Geometry)

# ---- group: Monomer + Side/Top / Monomer Type
filter_24 = StreamFilter(Gate=list, Stream0=item_44, Stream1=item_44, Stream2=item_44)

# ----
# 槽埋-角部倾斜时
bbox_9 = BoundingBox(Content=item_44, Plane=PlaneXY(0, 0, 0))  # -> Box, Box_2
ln_31 = Line(StartPoint=pt_32, EndPoint=pt_33)
debrep = DeconstructBrep(Brep=bbox_9.Box)  # -> Faces, Edges, Vertices
deplane_24 = DeconstructPlane(Plane=ln_31)  # -> Origin, XAxis, YAxis, ZAxis
len_7 = Length(Curve=debrep.Edges)
sort_19 = SortList(Keys=len_7, ValuesA=debrep.Edges)  # -> Keys, reverse(ValuesA)
amp_17 = Amplitude(Vector=deplane_24.XAxis, Amplitude=Slider(63.5, range=10..100))
item_48 = ListItem(List=sort_19.ValuesA, Index=0, Wrap=True)  # -> Item, Item1, Item2
item_49 = ListItem(List=sort_19.ValuesA, Index=0, Wrap=True)
move_28 = Move(Geometry=deplane_24.Origin, Motion=amp_17)  # -> Geometry, Transform
len_8 = Length(Curve=item_49)
end_8 = EndPoints(Curve=item_48.Item2)  # -> Start, End
end_9 = EndPoints(Curve=item_48.Item1)  # -> Start, End
ln_32 = Line(StartPoint=deplane_24.Origin, EndPoint=move_28.Geometry)
ln_33 = Line(StartPoint=move_28.Geometry, EndPoint=deplane_24.Origin)
avr = Average(Input=[end_9.Start, end_9.End])
ln_34 = Line(StartPoint=end_8.Start, EndPoint=end_8.End)
ln_35 = Line(StartPoint=end_9.Start, EndPoint=avr)
c_script_5 = CSharpScript(iReset=Toggle(True), turns=Slider(30, range=0..100), steps=Slider(10, range=0..10))  # -> out, num; inputs numDefault: Double, iReset: Boolean, turns: Int32, steps: Double
# ---------- c_script_5: C# ----------
    if(iReset){
      number = 0;}

    for(int i = 0; i < turns;i++){
      number = number + steps;
      numStore.Add(number);
      Print(number.ToString());}

    num = numStore;
# ---------- c_script_5: C# additional code ----------
  double number = 0;
  List <double> numStore = new List<double>();
# ---------- end c_script_5 ----------
pl_13 = ConstructPlane(Origin=avr, XAxis=ln_35, YAxis=ln_34)
panel_48 = Panel(c_script_5.num)
amp_18 = Amplitude(Vector=ln_31, Amplitude=graft(c_script_5.num))

item_50 = ListItem(List=flatten(len_8), Index=0, Wrap=True)

ln_36 = Line(StartPoint=pt_32, EndPoint=pt_33)
move_29 = Move(Geometry=pt_33, Motion=ln_36)  # -> Geometry, Transform
ccx_16 = CurveCurve(CurveA=cir_3, CurveB=offset)  # -> Points, ParamsA, ParamsB
item_51 = ListItem(List=ccx_16.Points, Index=0, Wrap=True)  # -> flatten(Item), flatten(Item1)
ln_37 = Line(StartPoint=pt_33, EndPoint=item_51.Item)
ln_38 = Line(StartPoint=pt_33, EndPoint=move_29.Geometry)
ln_39 = Line(StartPoint=pt_33, EndPoint=item_51.Item1)
angle_4 = Angle(VectorA=ln_37, VectorB=ln_38)  # -> Angle, Reflex
angle_5 = Angle(VectorA=ln_39, VectorB=ln_38)  # -> Angle, Reflex
deg_7 = Degrees(Radians=angle_4.Angle)
deg_8 = Degrees(Radians=angle_5.Angle)
item_52 = ListItem(List=ln_38, Index=Slider(3, range=0..4), Wrap=True)
tan = Tangent(Value=degrees(deg_7))
entwine_15 = Entwine(Branch00=ln_37, Branch01=tan, FlattenInputs=True)
tan_2 = Tangent(Value=degrees(deg_8))
division_11 = Division(A=tan, B=tan_2)
panel_49 = Panel(deg_8)
panel_50 = Panel(deg_7)
addition_7 = Addition(A=division_11, B=1)
division_12 = Division(A="1", B=addition_7)
subtraction = Subtraction(A="1", B=division_12)
num = Number(division_12)
larger_8 = LargerThan(FirstNumber=tan, SecondNumber=tan_2)  # -> LargerThan, OrEqualTo

amp_19 = Amplitude(Vector=ln_33, Amplitude=expr("x/2", flatten(item_50)))
amp_20 = Amplitude(Vector=ln_32, Amplitude=expr("x/2", flatten(item_50)))
move_30 = Move(Geometry=pt_33, Motion=amp_19)  # -> Geometry, Transform
move_31 = Move(Geometry=pt_33, Motion=amp_20)  # -> Geometry, Transform
ln_40 = Line(StartPoint=move_30.Geometry, EndPoint=move_31.Geometry)

crv_57 = Curve(ln_40)
mp = Midpoint(Curve=crv_57)
eval_8 = EvaluateCurve(Curve=crv_57, Parameter=subtraction)  # -> Point, Tangent, Angle
eval_9 = EvaluateCurve(Curve=crv_57, Parameter=num)  # -> Point, Tangent, Angle
dispatch_28 = Dispatch(List=eval_8.Point, DispatchPattern=larger_8.OrEqualTo)  # -> ListA, ListB
dispatch_29 = Dispatch(List=eval_9.Point, DispatchPattern=larger_8.OrEqualTo)  # -> ListA, ListB
pt_34 = Point(dispatch_28.ListB)
pt_35 = Point(dispatch_29.ListA)
merge_17 = Merge(Data1=pt_35, Data2=pt_34)
pull_26 = PullPoint(Point=merge_17, Geometry=graft(mp), ClosestOnly=True)  # -> ClosestPoint, Distance
panel_51 = Panel(merge_17)
sort_20 = SortList(Keys=pull_26.Distance, ValuesA=merge_17)  # -> Keys, ValuesA
item_53 = ListItem(List=sort_20.ValuesA, Index=0, Wrap=True)  # -> flatten(Item)
ln_41 = Line(StartPoint=item_53, EndPoint=mp)
panel_52 = Panel(item_53)
move_32 = Move(Geometry=crv_57, Motion=ln_41)  # -> Geometry, Transform

# ---- group: 正常和阳角 - BoundingBox — 测Intersection
entwine_16 = Entwine(Branch00=flip.Curve, Branch01=offset, FlattenInputs=True)
flip_5 = FlipMatrix(Data=entwine_16)
item_54 = ListItem(List=flip_5, Index=0, Wrap=True)  # -> Item, Item1

# ----
move_33 = Move(Geometry=move_32.Geometry, Motion=amp_18)  # -> Geometry, Transform
ccx_17 = CurveCurve(CurveA=move_33.Geometry, CurveB=crv_22)  # -> Points, ParamsA, ParamsB
item_55 = ListItem(List=ccx_17.Points, Index=0, Wrap=True)
item_56 = ListItem(List=ccx_17.Points, Index="-1", Wrap=True)
pshift_6 = ShiftPaths(Data=item_55, Offset=-1)
pshift_7 = ShiftPaths(Data=item_56, Offset=-1)
flip_6 = FlipMatrix(Data=pshift_6)
flip_7 = FlipMatrix(Data=pshift_7)
pt_36 = Point(flip_6)
pt_37 = Point(flip_7)
pull_27 = PullPoint(Point=pt_36, Geometry=graft(mp), ClosestOnly=True)  # -> ClosestPoint, Distance
pull_28 = PullPoint(Point=pt_37, Geometry=graft(mp), ClosestOnly=True)  # -> ClosestPoint, Distance
sort_21 = SortList(Keys=pull_27.Distance, ValuesA=pt_36)  # -> Keys, ValuesA
sort_22 = SortList(Keys=pull_28.Distance, ValuesA=pt_37)  # -> Keys, ValuesA
item_57 = ListItem(List=sort_21.ValuesA, Index="-1", Wrap=True)
item_58 = ListItem(List=sort_22.ValuesA, Index="-1", Wrap=True)
ln_42 = Line(StartPoint=item_58, EndPoint=item_57)

end_10 = EndPoints(Curve=ln_42)  # -> Start, End

avr_2 = Average(Input=[end_10.Start, end_10.End])
pl_14 = ConstructPlane(Origin=avr_2, XAxis=ln_42, YAxis=graft(ln_31))
orient_10 = Orient(Geometry=graft(item_45), Source=pl_13, Target=pl_14)  # -> Geometry, Transform
orient_11 = Orient(Geometry=graft(item_44), Source=pl_13, Target=pl_14)  # -> Geometry, Transform

filter_25 = StreamFilter(Gate=list_8, Stream0=item_44, Stream1=orient_11.Geometry)

# ---- group: Monomer + Side/Top / Monomer Type (continued)
filter_26 = StreamFilter(Gate=list, Stream0=item_44, Stream1=filter_25, Stream2=item_44)

# ---- group: Monomer + Side/Top / Top/Side
filter_27 = StreamFilter(Gate=list_2, Stream0=filter_26, Stream1=filter_24)

# ----
filter_28 = StreamFilter(Gate=list_8, Stream0=item_45, Stream1=orient_10.Geometry)

# ---- group: 阳角分类
filter_29 = StreamFilter(Gate=list, Stream0=item_45, Stream1=filter_28, Stream2=item_45)
filter_30 = StreamFilter(Gate=list, Stream0=item_45, Stream1=item_45, Stream2=item_45)
filter_31 = StreamFilter(Gate=list_2, Stream0=filter_29, Stream1=filter_30)

# ----
阳角 = Geometry(filter_31)

# ---- group: 正常和阳角 - BoundingBox — 测Intersection (continued)
c_script_6 = CSharpScript(BrepMain=item_46, BrepStay=filter_27)  # -> out, BrepInters, BrepRemain, IndexM, IndexS; inputs BrepMain: list of Brep, BrepStay: list of Brep
# ---------- c_script_6: C# ----------
    List<Brep> BrepI = new List<Brep>();
    List<Brep> BrepR = new List<Brep>();
    List<int> num = new List<int>();
    List<int> numS = new List<int>();


    double tolr = Rhino.RhinoDoc.ActiveDoc.ModelAbsoluteTolerance;

    for(int j = 0; j < BrepMain.Count;j++){
      for(int i = 0; i < BrepStay.Count;i++){
        bool test = Rhino.Geometry.Intersect.Intersection.BrepBrep(BrepMain[j], BrepStay[i], tolr, out crv, out pts);
        if(test && crv.Length != 0){
          tryThis = true;
          numS.Add(i);
          break;}
        else{
          tryThis = false;}
      }
      if(tryThis){
        BrepI.Add(BrepMain[j]);
        num.Add(j);
      }
      else{
        BrepR.Add(BrepMain[j]);
      }
    }



    BrepInters = BrepI;
    BrepRemain = BrepR;
    IndexM = num;
    IndexS = numS;
# ---------- c_script_6: C# additional code ----------
  Rhino.Geometry.Curve[] crv;
  Rhino.Geometry.Point3d[] pts;
  bool tryThis;
# ---------- end c_script_6 ----------
item_59 = ListItem(List=item_46, Index=c_script_6.IndexM, Wrap=True)  # -> graft(Item)
item_60 = ListItem(List=filter_27, Index=c_script_6.IndexS, Wrap=True)  # -> graft(Item)
cull_i_18 = CullIndex(List=item_47, Indices=c_script_6.IndexM, Wrap=True)
item_61 = ListItem(List=item_47, Index=c_script_6.IndexM, Wrap=True)  # -> graft(Item)
area_14 = Area(Geometry=item_59)  # -> Area, Centroid
bbx = BrepBrep(BrepA=item_59, BrepB=item_60)  # -> simplify(Curves), Points
area_15 = Area(Geometry=bbx.Curves)  # -> Area, Centroid
ln_43 = Line(StartPoint=area_14.Centroid, EndPoint=area_15.Centroid)
mp_2 = Midpoint(Curve=ln_43)
scale_14 = Scale(Geometry=ln_43, Center=mp_2, Factor=Slider(1000000, range=0..1000000))  # -> Geometry, Transform
ccx_18 = CurveCurve(CurveA=scale_14.Geometry, CurveB=bbx.Curves)  # -> Points, ParamsA, ParamsB
item_62 = ListItem(List=ccx_18.Points, Index=0, Wrap=True)  # -> Item, Item1
ln_44 = Line(StartPoint=item_62.Item1, EndPoint=item_62.Item)
move_34 = Move(Geometry=item_61, Motion=ln_44)  # -> simplify(Geometry), Transform
bbox_10 = BoundingBox(Content=move_34.Geometry, Plane=PlaneXY(0, 0, 0))  # -> Box, Box_2

# ----
# 这里如果跑红也不要紧，
# 说明单体没有出现相撞的情况
area_16 = Area(Geometry=bbox_10.Box)  # -> Area, Centroid

# ---- group: 正常和阳角 - BoundingBox — 测Intersection (continued)
entwine_17 = Entwine(Branch00=move_34.Geometry, Branch01=area_16.Centroid, FlattenInputs=True)
flip_8 = FlipMatrix(Data=entwine_17)
item_63 = ListItem(List=flip_8, Index="0", Wrap=True)  # -> flatten(Item)
item_64 = ListItem(List=flip_8, Index="-1", Wrap=True)  # -> flatten(Item)
pull_29 = PullPoint(Point=item_64, Geometry=item_54.Item, ClosestOnly=True)  # -> flatten(ClosestPoint), Distance
pull_30 = PullPoint(Point=item_64, Geometry=item_54.Item1, ClosestOnly=True)  # -> flatten(ClosestPoint), Distance
vec2pt_5 = Vector2Pt(PointA=item_64, PointB=pull_29.ClosestPoint, Unitize=False)  # -> Vector, Length
vec2pt_6 = Vector2Pt(PointA=item_64, PointB=pull_30.ClosestPoint, Unitize=False)  # -> Vector, Length
multiplication_13 = Multiplication(A=vec2pt_5.Vector, B=vec2pt_6.Vector)
larger_9 = LargerThan(FirstNumber=multiplication_13, SecondNumber=0)  # -> LargerThan, OrEqualTo
dispatch_30 = Dispatch(List=item_63, DispatchPattern=larger_9.LargerThan)  # -> ListA, ListB

# ---- group: Normal
geo_7 = Geometry(cull_i_18)

# ---- group: Normal-Move
移动 = Geometry(dispatch_30.ListA)

# ----
# PLAN Results
merge_18 = Merge(Data1=geo_7, Data2=阳角, Data3=移动, Data4=阴角)

# ----
# 1.是否有檐口线
toggle_4 = BooleanToggle(True)
clean_3 = CleanTree(RemoveNulls=True, RemoveInvalid=True, RemoveEmpty=toggle_4, Tree=merge_14)
crv_58 = Curve(crv_6)
deplane_25 = DeconstructPlane(Plane=clean_3)  # -> Origin, XAxis, YAxis, ZAxis
incurve = PointInCurve(Point=deplane_25.Origin, Curve=crv_58)  # -> Relationship, Point
equals_3 = Equality(FirstNumber=incurve.Relationship, SecondNumber="2")  # -> Equality, Inequality
dispatch_31 = Dispatch(List=clean_3, DispatchPattern=equals_3.Equality)  # -> ListA, ListB
crv_59 = Curve(crv_8)

# ----
# Site - 有檐口线的定位点
pln_19 = Plane(dispatch_31.ListA)

# ----
# Site - 无檐口线的定位点
pln_20 = Plane(dispatch_31.ListB)

incurves = PointInCurves(Point=pln_19, Curves=crv_59)  # -> Relationship, Index, Point
equals_4 = Equality(FirstNumber=incurves.Relationship, SecondNumber="2")  # -> Equality, Inequality
dispatch_32 = Dispatch(List=pln_19, DispatchPattern=equals_4.Equality)  # -> ListA, ListB
pln_21 = Plane(dispatch_32.ListB)

# ----
# 檐口出特殊处理
# 比如作为吊顶处理
pln_22 = Plane(dispatch_32.ListA)

# ----
# 1.1有檐口线
pln_23 = Plane(pln_21)

# ----
# 1.0无檐口线初筛
pln_24 = Plane(pln_20)

deplane_26 = DeconstructPlane(Plane=pln_24)  # -> Origin, XAxis, YAxis, ZAxis
crv_60 = Curve(filter_8)
incurves_2 = PointInCurves(Point=deplane_26.Origin, Curves=flatten(crv_60))  # -> Relationship, Index, Point
equals_5 = Equality(FirstNumber=incurves_2.Relationship, SecondNumber="2")  # -> Equality, Inequality
dispatch_33 = Dispatch(List=pln_24, DispatchPattern=equals_5.Equality)  # -> ListA, ListB
crv_61 = Curve(crv_59)
data_43 = Data(dispatch_33.ListB)

# ----
# 1.1.1布埋件
pln_25 = Plane(pln_23)

# ----
# 0.有檐口-整个site一起处理
deplane_27 = DeconstructPlane(Plane=pln_25)  # -> Origin, XAxis, YAxis, ZAxis
amp_21 = Amplitude(Vector=deplane_27.YAxis, Amplitude=number_slider_6)
move_35 = Move(Geometry=deplane_27.Origin, Motion=amp_21)  # -> Geometry, Transform
ln_45 = Line(StartPoint=deplane_27.Origin, EndPoint=move_35.Geometry)
ccx_19 = CurveCurve(CurveA=graft(ln_45), CurveB=flatten(merge_4))  # -> Points, ParamsA, ParamsB
shift = ShiftPaths(Data=ccx_19.Points, Offset=-1)
sort_23 = SortList(Keys=shift, ValuesA=shift)  # -> Keys, ValuesA
pull_31 = PullPoint(Point=sort_23.ValuesA, Geometry=graft(deplane_27.Origin), ClosestOnly=True)  # -> ClosestPoint, Distance
sort_24 = SortList(Keys=pull_31.Distance, ValuesA=sort_23.ValuesA)  # -> Keys, ValuesA
item_65 = ListItem(List=sort_24.ValuesA, Index="-1", Wrap=True)
null_6 = NullItem(Item=flatten(item_65))  # -> NullFlags, InvalidFlags, Description
dispatch_34 = Dispatch(List=item_65, DispatchPattern=item_65)  # -> ListA, ListB
dispatch_35 = Dispatch(List=pln_25, DispatchPattern=null_6.InvalidFlags)  # -> ListA, ListB
data_44 = Data(dispatch_34.ListA)
data_45 = Data(dispatch_35.ListB)
check_same_points_5 = CheckSamePoints(archPoint=pln_25, crvPoint=data_45)  # -> out, specialPt; inputs archPoint: list of Point3d, crvPoint: list of Point3d; same code as testpoint
deplane_28 = DeconstructPlane(Plane=data_45)  # -> Origin, XAxis, YAxis, ZAxis

pln_26 = Plane(dispatch_33.ListA)
incurves_3 = PointInCurves(Point=pln_26, Curves=flatten(crv_61))  # -> Relationship, Index, Point
equals_6 = Equality(FirstNumber=incurves_3.Relationship, SecondNumber="0")  # -> Equality, Inequality
dispatch_36 = Dispatch(List=pln_26, DispatchPattern=equals_6.Equality)  # -> ListA, ListB
pln_27 = Plane(dispatch_36.ListB)

# ----
# 1.0无檐口线
pln_28 = Plane(dispatch_36.ListA)

# ----
# 1.0无檐口线+上下层幕墙边线连续
crv_62 = Curve(crv)
crv_63 = Curve(crv_4)
pln_29 = Plane(pln_28)
deplane_29 = DeconstructPlane(Plane=pln_29)  # -> Origin, XAxis, YAxis, ZAxis
number_slider_24 = Slider(3584, range=0..10000)
amp_22 = Amplitude(Vector=deplane_29.YAxis, Amplitude=number_slider_24)
amp_23 = Amplitude(Vector=deplane_29.YAxis, Amplitude=expr("-x", number_slider_24))
move_36 = Move(Geometry=deplane_29.Origin, Motion=amp_22)  # -> Geometry, Transform
move_37 = Move(Geometry=deplane_29.Origin, Motion=amp_23)  # -> Geometry, Transform
ln_46 = Line(StartPoint=move_37.Geometry, EndPoint=move_36.Geometry)
ccx_20 = CurveCurve(CurveA=ln_46, CurveB=crv_62)  # -> flatten(Points), ParamsA, ParamsB
ccx_21 = CurveCurve(CurveA=ln_46, CurveB=crv_63)  # -> flatten(Points), ParamsA, ParamsB
pull_32 = PullPoint(Point=ccx_21.Points, Geometry=ccx_20.Points, ClosestOnly=True)  # -> ClosestPoint, Distance
sort_25 = SortList(Keys=pull_32.Distance, ValuesA=pull_32.ClosestPoint)  # -> Keys, ValuesA
pln_30 = Plane(pln_29)
panel_53 = Panel(sort_25.Keys)
larger_10 = LargerThan(FirstNumber=sort_25.Keys, SecondNumber=Slider(1.1, range=0..10))  # -> LargerThan, OrEqualTo
dispatch_37 = Dispatch(List=sort_25.ValuesA, DispatchPattern=larger_10.LargerThan)  # -> ListA, ListB
pt_38 = Point(dispatch_37.ListB)
pt_39 = Point(dispatch_37.ListA)
pull_33 = PullPoint(Point=deplane_29.Origin, Geometry=graft(pt_38), ClosestOnly=True)  # -> ClosestPoint, Distance
sort_26 = SortList(Keys=pull_33.Distance, ValuesA=pln_30)  # -> Keys, ValuesA
item_66 = ListItem(List=sort_26.ValuesA, Index=0, Wrap=True)
check_same_points_6 = CheckSamePoints(archPoint=pln_30, crvPoint=flatten(item_66))  # -> out, specialPt; inputs archPoint: list of Point3d, crvPoint: list of Point3d; same code as testpoint
item_67 = ListItem(List=pln_30, Index=check_same_points_6.specialPt, Wrap=True)
deplane_30 = DeconstructPlane(Plane=item_67)  # -> Origin, XAxis, YAxis, ZAxis
amp_24 = Amplitude(Vector=deplane_30.YAxis, Amplitude=expr("-x", Slider(2756, range=0..10000)))
crv_64 = Curve(merge_4)
move_38 = Move(Geometry=deplane_30.Origin, Motion=amp_24)  # -> Geometry, Transform
ln_47 = Line(StartPoint=deplane_30.Origin, EndPoint=move_38.Geometry)
ccx_22 = CurveCurve(CurveA=graft(ln_47), CurveB=flatten(crv_64))  # -> Points, ParamsA, ParamsB
shift_2 = ShiftPaths(Data=ccx_22.Points, Offset=-1)
pull_34 = PullPoint(Point=deplane_30.Origin, Geometry=shift_2, ClosestOnly=True)  # -> ClosestPoint, Distance
sort_27 = SortList(Keys=pull_34.Distance, ValuesA=pull_34.ClosestPoint)  # -> Keys, ValuesA
item_68 = ListItem(List=sort_27.ValuesA, Index=0, Wrap=True)
null_7 = NullItem(Item=flatten(item_68))  # -> NullFlags, InvalidFlags, Description
dispatch_38 = Dispatch(List=item_67, DispatchPattern=null_7.InvalidFlags)  # -> ListA, ListB
dispatch_39 = Dispatch(List=item_68, DispatchPattern=item_68)  # -> ListA, ListB
data_46 = Data(dispatch_38.ListB)
data_47 = Data(dispatch_39.ListA)
flatten_18 = FlattenTree(Tree=data_47, Path="{0}")
ln_48 = Line(StartPoint=data_46, EndPoint=flatten_18)
len_9 = Length(Curve=ln_48)
sort_28 = SortList(Keys=len_9)  # -> reverse(Keys), ValuesA
move2pt_16 = MoveToPoint(Geometry=data_46, PointA=data_46, PointB=flatten(data_47))  # -> Moved, Vector, Transform

# ----
# 0无檐口线
# 与梁不相交
cull_i_19 = CullIndex(List=pln_25, Indices=check_same_points_5.specialPt, Wrap=True)

# ----
# 0.Missing Point
# 埋件定位点Offset，没有找到和梁的交点
crv_65 = Curve(merge_4)
disc_14 = Discontinuity(Curve=crv_65, Level=1)  # -> Points, Parameters
cullduppoints_5 = RemoveDuplicatePoints(InputPoints=flatten(disc_14.Points), Tolerance=0.001)  # -> OutputPoints, FirstPointIndexes
pln_31 = Plane(cull_i_19)
pull_35 = PullPoint(Point=pln_31, Geometry=flatten(cullduppoints_5.OutputPoints), ClosestOnly=True)  # -> ClosestPoint, Distance
check_same_points_7 = CheckSamePoints(archPoint=flatten(cullduppoints_5.OutputPoints), crvPoint=pull_35.ClosestPoint)  # -> out, specialPt; inputs archPoint: list of Point3d, crvPoint: list of Point3d; same code as testpoint
ln_49 = Line(StartPoint=cull_i_19, EndPoint=pull_35.ClosestPoint)
cull_i_20 = CullIndex(List=flatten(cullduppoints_5.OutputPoints), Indices=check_same_points_7.specialPt, Wrap=True)
item_69 = ListItem(List=flatten(cullduppoints_5.OutputPoints), Index=check_same_points_7.specialPt, Wrap=True)
pull_36 = PullPoint(Point=item_69, Geometry=cull_i_20, ClosestOnly=True)  # -> ClosestPoint, Distance
pull_37 = PullPoint(Point=pln_31, Geometry=item_69, ClosestOnly=True)  # -> ClosestPoint, Distance
pull_38 = PullPoint(Point=pull_37.ClosestPoint, Geometry=pull_36.ClosestPoint, ClosestOnly=True)  # -> ClosestPoint, Distance
ln_50 = Line(StartPoint=pull_37.ClosestPoint, EndPoint=pull_38.ClosestPoint)
deplane_31 = DeconstructPlane(Plane=pln_31)  # -> Origin, XAxis, YAxis, ZAxis
midpt_20 = CurveMiddle(Curve=ln_50)
number_slider_25 = Slider(500, range=0..1000)
amp_25 = Amplitude(Vector=deplane_31.XAxis, Amplitude=expr("-x", number_slider_25))
amp_26 = Amplitude(Vector=deplane_31.XAxis, Amplitude=number_slider_25)
move_39 = Move(Geometry=midpt_20, Motion=amp_26)  # -> Geometry, Transform
move_40 = Move(Geometry=midpt_20, Motion=amp_25)  # -> Geometry, Transform
entwine_18 = Entwine(Branch00=deplane_31.Origin, Branch01=deplane_31.Origin, FlattenInputs=True)
entwine_19 = Entwine(Branch00=move_39.Geometry, Branch01=move_40.Geometry, FlattenInputs=True)

# ----
# 0.檐口处侧埋，钢板焊
# 02：钢板焊埋件[钢梁外侧]
# @钢边梁宽@钢边梁高
move2pt_17 = MoveToPoint(Geometry=data_45, PointA=deplane_28.Origin, PointB=flatten(data_44))  # -> Moved, Vector, Transform

# ----
# 0 檐口出定位点与结构无交点
pln_32 = Plane(cull_i_19)
pt_40 = Point(pln_32)

# ----
# 0 檐口出特殊处理
# 比如作为吊顶处理
pln_33 = Plane(pln_22)
pt_41 = Point(pln_33)

# ----
# 可能的双定位点
move2pt_18 = MoveToPoint(Geometry=pln_31, PointA=entwine_18, PointB=entwine_19)  # -> Moved, Vector, Transform

# ----
# 与梁无交点的定位点
pln_34 = Plane(dispatch_38.ListA)

cull_i_21 = CullIndex(List=pln_30, Indices=check_same_points_6.specialPt, Wrap=True)
pln_35 = Plane(pln_23)
merge_19 = Merge(Data1=cull_i_21, Data2=pln_35)  # -> flatten(Result)

number = NumberGroups(Number=sort_28.Keys, Difference=Slider(50, range=0..100))  # -> simplify(Groups), Indices
panel_54 = Panel(number.Groups)
tstat = TreeStatistics(Tree=number.Groups)  # -> Paths, Length, Count
lng_6 = ListLength(List=tstat.Paths)
smaller_10 = SmallerThan(FirstNumber=lng_6, SecondNumber="2")  # -> SmallerThan, OrEqualTo
dispatch_40 = Dispatch(List=smaller_10.OrEqualTo, DispatchPattern=[True, False])  # -> ListA, ListB
filter_32 = StreamFilter(Gate=dispatch_40.ListA, Stream0="-2", Stream1="-1")
item_70 = ListItem(List=tstat.Paths, Index=filter_32, Wrap=True)
branch = TreeBranch(Tree=number.Groups, Path=item_70, MaintainPaths=True)
sort_29 = SortList(Keys=branch)  # -> reverse(Keys), ValuesA
round_3 = Round(Number=sort_29.Keys)  # -> Nearest, Floor, Ceiling
item_71 = ListItem(List=round_3.Ceiling, Index=0, Wrap=True)

list_12 = ValueList({"自己输入Value": 0, "GH Defaut Value": 1}, selected="GH Defaut Value")
panel_55 = Panel(item_71)
filter_33 = StreamFilter(Gate=list_12, Stream0=Slider(1000, range=0..10000), Stream1=panel_55)

larger_11 = LargerThan(FirstNumber=len_9, SecondNumber=filter_33)  # -> LargerThan, OrEqualTo
dispatch_41 = Dispatch(List=flatten_18, DispatchPattern=larger_11.LargerThan)  # -> ListA, ListB
dispatch_42 = Dispatch(List=data_46, DispatchPattern=larger_11.LargerThan)  # -> ListA, ListB
data_48 = Data(dispatch_42.ListB)
data_49 = Data(dispatch_41.ListB)
move2pt_19 = MoveToPoint(Geometry=data_48, PointA=data_48, PointB=flatten(data_49))  # -> Moved, Vector, Transform

# ----
# 离梁过远的定位点
pln_36 = Plane(dispatch_42.ListA)

# ----
# 1.0无檐口线
# 与梁不相交
merge_20 = Merge(Data1=pln_34, Data2=pln_36)
filter_34 = StreamFilter(Gate=list_10, Stream0=merge_20, Stream1=pln_34)
disc_15 = Discontinuity(Curve=crv_64, Level=1)  # -> Points, Parameters
pln_37 = Plane(filter_34)
pull_39 = PullPoint(Point=pln_37, Geometry=flatten(disc_15.Points), ClosestOnly=True)  # -> ClosestPoint, Distance
check_same_points_8 = CheckSamePoints(archPoint=flatten(disc_15.Points), crvPoint=pull_39.ClosestPoint)  # -> out, specialPt; inputs archPoint: list of Point3d, crvPoint: list of Point3d; same code as testpoint
item_72 = ListItem(List=flatten(disc_15.Points), Index=check_same_points_8.specialPt, Wrap=True)
cull_i_22 = CullIndex(List=flatten(disc_15.Points), Indices=check_same_points_8.specialPt, Wrap=True)
pull_40 = PullPoint(Point=item_72, Geometry=cull_i_22, ClosestOnly=True)  # -> ClosestPoint, Distance
pt_42 = Point(item_72)
pt_43 = Point(pull_40.ClosestPoint)
ln_51 = Line(StartPoint=pt_42, EndPoint=pt_43)
number_slider_26 = Slider(500, range=0..1000)
midpt_21 = CurveMiddle(Curve=ln_51)
deplane_32 = DeconstructPlane(Plane=pln_37)  # -> Origin, XAxis, YAxis, ZAxis
amp_27 = Amplitude(Vector=deplane_32.XAxis, Amplitude=number_slider_26)
amp_28 = Amplitude(Vector=deplane_32.XAxis, Amplitude=expr("-x", number_slider_26))
move_41 = Move(Geometry=midpt_21, Motion=amp_27)  # -> Geometry, Transform
move_42 = Move(Geometry=midpt_21, Motion=amp_28)  # -> Geometry, Transform
entwine_20 = Entwine(Branch00=move_41.Geometry, Branch01=move_42.Geometry, FlattenInputs=True)
entwine_21 = Entwine(Branch00=deplane_32.Origin, Branch01=deplane_32.Origin, FlattenInputs=True)

# ----
# 可能的双定位点
move2pt_20 = MoveToPoint(Geometry=pln_37, PointA=entwine_21, PointB=entwine_20)  # -> Moved, Vector, Transform

# ----
# 单定位点
filter_35 = StreamFilter(Gate=list_10, Stream0=move2pt_19.Moved, Stream1=move2pt_16.Moved)

# ----
# 可能的双定位点
pln_38 = Plane(merge_20)
pt_44 = Point(pln_38)

# ----
# 1.2是否有吊顶
crv_66 = Curve(crv_7)
incurves_4 = PointInCurves(Point=merge_19, Curves=crv_66)  # -> Relationship, Index, Point
equals_7 = Equality(FirstNumber=incurves_4.Relationship, SecondNumber="0")  # -> Equality, Inequality
dispatch_43 = Dispatch(List=merge_19, DispatchPattern=equals_7.Equality)  # -> ListA, ListB
pln_39 = Plane(dispatch_43.ListB)
number_slider_27 = Slider(5000, range=0..10000)
crv_67 = Curve(crv_4)
crv_68 = Curve(merge_3)

# ----
# 和下层楼板发生关系的定位点
pln_40 = Plane(dispatch_43.ListA)

pln_41 = Plane(pln_40)

number_slider_28 = Slider(3584, range=0..10000)
deplane_33 = DeconstructPlane(Plane=pln_41)  # -> Origin, XAxis, YAxis, ZAxis
amp_29 = Amplitude(Vector=deplane_33.YAxis, Amplitude=number_slider_28)
amp_30 = Amplitude(Vector=deplane_33.YAxis, Amplitude=expr("-x", number_slider_28))
crv_69 = Curve(merge_3)
boundary_4 = BoundarySurfaces(Edges=[offset_3, offset_4])
move_43 = Move(Geometry=deplane_33.Origin, Motion=amp_30)  # -> Geometry, Transform
move_44 = Move(Geometry=deplane_33.Origin, Motion=amp_29)  # -> Geometry, Transform
scx = SurfaceCurve(Surface=boundary_4, Curve=crv_69)  # -> flatten(Curves), Points, UVPoints, Normals, Parameters, Tangents
ln_52 = Line(StartPoint=move_43.Geometry, EndPoint=move_44.Geometry)
ccx_23 = CurveCurve(CurveA=graft(ln_52), CurveB=scx.Curves)  # -> Points, ParamsA, ParamsB
shift_3 = ShiftPaths(Data=ccx_23.Points, Offset=-1)
pull_41 = PullPoint(Point=graft(pln_41), Geometry=shift_3, ClosestOnly=True)  # -> ClosestPoint, Distance
sort_30 = SortList(Keys=pull_41.Distance, ValuesA=pull_41.ClosestPoint)  # -> Keys, ValuesA
null_8 = NullItem(Item=sort_30.ValuesA)  # -> NullFlags, simplify(InvalidFlags), Description
dispatch_44 = Dispatch(List=simplify(graft(pln_41)), DispatchPattern=null_8.InvalidFlags)  # -> ListA, ListB
item_73 = ListItem(List=sort_30.ValuesA, Index=0, Wrap=True)
pln_42 = Plane(dispatch_44.ListA)
pln_43 = Plane(dispatch_44.ListB)

pln_44 = Plane(pln_41)
number_slider_29 = Slider(3584, range=0..10000)
deplane_34 = DeconstructPlane(Plane=pln_44)  # -> Origin, XAxis, YAxis, ZAxis
crv_70 = Curve(merge_4)
boundary_5 = BoundarySurfaces(Edges=[offset_6, offset_5])
scx_2 = SurfaceCurve(Surface=boundary_5, Curve=crv_70)  # -> flatten(Curves), Points, UVPoints, Normals, Parameters, Tangents
amp_31 = Amplitude(Vector=deplane_34.YAxis, Amplitude=number_slider_29)
amp_32 = Amplitude(Vector=deplane_34.YAxis, Amplitude=expr("-x", number_slider_29))
move_45 = Move(Geometry=deplane_34.Origin, Motion=amp_32)  # -> Geometry, Transform
move_46 = Move(Geometry=deplane_34.Origin, Motion=amp_31)  # -> Geometry, Transform
ln_53 = Line(StartPoint=move_45.Geometry, EndPoint=move_46.Geometry)
ccx_24 = CurveCurve(CurveA=graft(ln_53), CurveB=scx_2.Curves)  # -> Points, ParamsA, ParamsB
shift_4 = ShiftPaths(Data=ccx_24.Points, Offset=-1)
pull_42 = PullPoint(Point=graft(pln_44), Geometry=shift_4, ClosestOnly=True)  # -> ClosestPoint, Distance
sort_31 = SortList(Keys=pull_42.Distance, ValuesA=pull_42.ClosestPoint)  # -> Keys, ValuesA
null_9 = NullItem(Item=sort_31.ValuesA)  # -> NullFlags, simplify(InvalidFlags), Description
dispatch_45 = Dispatch(List=simplify(graft(pln_44)), DispatchPattern=null_9.InvalidFlags)  # -> ListA, ListB
item_74 = ListItem(List=sort_31.ValuesA, Index=0, Wrap=True)
pln_45 = Plane(dispatch_45.ListB)
pln_46 = Plane(dispatch_45.ListA)

# ----
# 1.2.2
# 下层建筑边线外侧50-350mm
# 03：钢板焊埋件[钢梁内侧]
# @钢边梁宽@钢边梁高
move2pt_21 = MoveToPoint(Geometry=pln_43, PointA=pln_43, PointB=item_73)  # -> Moved, Vector, Transform

pln_47 = Plane(pln_46)

# ----
# 3.1下层建筑内侧到300到外侧50内是否有钢结构
pln_48 = Plane(pln_42)
deplane_35 = DeconstructPlane(Plane=pln_47)  # -> Origin, XAxis, YAxis, ZAxis
deplane_36 = DeconstructPlane(Plane=pln_48)  # -> Origin, XAxis, YAxis, ZAxis
check_same_points_9 = CheckSamePoints(archPoint=deplane_35.Origin, crvPoint=deplane_36.Origin)  # -> out, specialPt; inputs archPoint: list of Point3d, crvPoint: list of Point3d; same code as testpoint

# ----
# 1.2.3
# 下层建筑边线内侧300-600mm范围
# 03：钢板焊埋件[钢梁外侧]
# @钢边梁宽@钢边梁高
move2pt_22 = MoveToPoint(Geometry=pln_45, PointA=pln_45, PointB=simplify(item_74))  # -> Moved, Vector, Transform

# ----
# 同时满足N
item_75 = ListItem(List=pln_47, Index=check_same_points_9.specialPt, Wrap=True)

pln_49 = Plane(item_75)
number_slider_30 = Slider(3584, range=0..10000)
deplane_37 = DeconstructPlane(Plane=pln_49)  # -> Origin, XAxis, YAxis, ZAxis
boundary_6 = BoundarySurfaces(Edges=[offset_8, offset_7])
crv_71 = Curve(crv_3)
amp_33 = Amplitude(Vector=deplane_37.YAxis, Amplitude=number_slider_30)
amp_34 = Amplitude(Vector=deplane_37.YAxis, Amplitude=expr("-x", number_slider_30))
scx_3 = SurfaceCurve(Surface=boundary_6, Curve=crv_71)  # -> flatten(Curves), Points, UVPoints, Normals, Parameters, Tangents
move_47 = Move(Geometry=deplane_37.Origin, Motion=amp_34)  # -> Geometry, Transform
move_48 = Move(Geometry=deplane_37.Origin, Motion=amp_33)  # -> Geometry, Transform
ln_54 = Line(StartPoint=move_47.Geometry, EndPoint=move_48.Geometry)
ccx_25 = CurveCurve(CurveA=graft(ln_54), CurveB=scx_3.Curves)  # -> Points, ParamsA, ParamsB
shift_5 = ShiftPaths(Data=ccx_25.Points, Offset=-1)
pull_43 = PullPoint(Point=graft(pln_49), Geometry=shift_5, ClosestOnly=True)  # -> ClosestPoint, Distance
sort_32 = SortList(Keys=pull_43.Distance, ValuesA=pull_43.ClosestPoint)  # -> Keys, ValuesA
null_10 = NullItem(Item=sort_32.ValuesA)  # -> NullFlags, simplify(InvalidFlags), Description
dispatch_46 = Dispatch(List=simplify(graft(pln_49)), DispatchPattern=null_10.InvalidFlags)  # -> ListA, ListB
item_76 = ListItem(List=sort_32.ValuesA, Index=0, Wrap=True)
pln_50 = Plane(dispatch_46.ListA)
pln_51 = Plane(dispatch_46.ListB)

# ----
# 3.1下层建筑内侧到300到外侧50内
# 底埋，钢板焊
move2pt_23 = MoveToPoint(Geometry=pln_51, PointA=pln_51, PointB=item_76)  # -> Moved, Vector, Transform

# ----
# 3.2下层建筑内侧到300到外侧50内
# 无钢结构
# 要求主体结构提供钢结构梁，默认位置为建筑边线向内300mm
pln_52 = Plane(pln_50)
crv_72 = Curve(crv_30)
offset_15 = OffsetCurve(Curve=crv_72, Distance=expr("-x", Slider(300, range=0..1000)), Corners=1)
pull_44 = PullPoint(Point=pln_52, Geometry=offset_15, ClosestOnly=True)  # -> ClosestPoint, Distance
sort_33 = SortList(Keys=pull_44.Distance)  # -> Keys, ValuesA
larger_12 = LargerThan(FirstNumber=pull_44.Distance, SecondNumber=Slider(400, range=0..1000))  # -> LargerThan, OrEqualTo
dispatch_47 = Dispatch(List=pln_52, DispatchPattern=larger_12.LargerThan)  # -> ListA, ListB
panel_56 = Panel(sort_33.Keys)
pln_53 = Plane(dispatch_47.ListB)
number_slider_31 = Slider(3584, range=0..10000)
deplane_38 = DeconstructPlane(Plane=pln_53)  # -> Origin, XAxis, YAxis, ZAxis
amp_35 = Amplitude(Vector=deplane_38.YAxis, Amplitude=number_slider_31)
amp_36 = Amplitude(Vector=deplane_38.YAxis, Amplitude=expr("-x", number_slider_31))
move_49 = Move(Geometry=deplane_38.Origin, Motion=amp_36)  # -> Geometry, Transform
move_50 = Move(Geometry=deplane_38.Origin, Motion=amp_35)  # -> Geometry, Transform
ln_55 = Line(StartPoint=move_49.Geometry, EndPoint=move_50.Geometry)
ccx_26 = CurveCurve(CurveA=ln_55, CurveB=offset_15)  # -> flatten(Points), ParamsA, ParamsB
pull_45 = PullPoint(Point=deplane_38.Origin, Geometry=ccx_26.Points, ClosestOnly=True)  # -> ClosestPoint, Distance

# ----
# 3.3上层建筑边线,
# 默认建筑提供上翻，如主结构提供示意则使用结构定位【该项目无】，
# 如无则使用建筑边线向内50mm作为埋件定位
merge_21 = Merge(Data1=pln_39, Data2=pln_41)
crv_73 = Curve(crv)
offset_16 = OffsetCurve(Curve=crv_73, Distance=expr("-x", Slider(50, range=0..100)), Corners=1)
pln_54 = Plane(merge_21)
number_slider_32 = Slider(3584, range=0..10000)
deplane_39 = DeconstructPlane(Plane=pln_54)  # -> Origin, XAxis, YAxis, ZAxis
amp_37 = Amplitude(Vector=deplane_39.YAxis, Amplitude=number_slider_32)
amp_38 = Amplitude(Vector=deplane_39.YAxis, Amplitude=expr("-x", number_slider_32))
move_51 = Move(Geometry=deplane_39.Origin, Motion=amp_38)  # -> Geometry, Transform
move_52 = Move(Geometry=deplane_39.Origin, Motion=amp_37)  # -> Geometry, Transform
ln_56 = Line(StartPoint=move_51.Geometry, EndPoint=move_52.Geometry)
ccx_27 = CurveCurve(CurveA=ln_56, CurveB=offset_16)  # -> simplify(Points), ParamsA, ParamsB
pull_46 = PullPoint(Point=deplane_39.Origin, Geometry=ccx_27.Points, ClosestOnly=True)  # -> ClosestPoint, Distance
ln_57 = Line(StartPoint=ccx_27.Points, EndPoint=simplify(graft(pln_54)))
len_10 = Length(Curve=ln_57)
sort_34 = SortList(Keys=len_10, ValuesA=simplify(ccx_27.Points))  # -> Keys, ValuesA
item_77 = ListItem(List=sort_34.ValuesA, Index=0, Wrap=True)

# ----
# 做吊顶，不处理？？
pln_55 = Plane(dispatch_47.ListA)

# ----
# 3.2默认位置为建筑边线向内300mm
# 侧埋，钢板焊
# 03：钢板焊埋件[钢梁外侧]@钢边梁宽@钢边梁高
move2pt_24 = MoveToPoint(Geometry=pln_53, PointA=deplane_38.Origin, PointB=pull_45.ClosestPoint)  # -> Moved, Vector, Transform

# ----
# 3.3上层建筑边线,
# 默认建筑提供上翻
# 04：板埋埋件[混凝土楼板上侧]@板埋参数xn
move2pt_25 = MoveToPoint(Geometry=simplify(graft(pln_54)), PointA=simplify(graft(pln_54)), PointB=item_77)  # -> Moved, Vector, Transform

deplane_40 = DeconstructPlane(Plane=pln_40)  # -> Origin, XAxis, YAxis, ZAxis
amp_39 = Amplitude(Vector=deplane_40.YAxis, Amplitude=expr("-x", number_slider_27))
amp_40 = Amplitude(Vector=deplane_40.YAxis, Amplitude=number_slider_27)
move_53 = Move(Geometry=deplane_40.Origin, Motion=amp_40)  # -> Geometry, Transform
move_54 = Move(Geometry=deplane_40.Origin, Motion=amp_39)  # -> Geometry, Transform
ln_58 = Line(StartPoint=move_53.Geometry, EndPoint=move_54.Geometry)
ccx_28 = CurveCurve(CurveA=ln_58, CurveB=crv_67)  # -> Points, ParamsA, ParamsB
null_11 = NullItem(Item=ccx_28.Points)  # -> NullFlags, InvalidFlags, Description
dispatch_48 = Dispatch(List=simplify(graft(pln_40)), DispatchPattern=simplify(null_11.NullFlags))  # -> ListA, ListB
flatten_19 = FlattenTree(Tree=ccx_28.Points, Path="{0}")
pln_56 = Plane(flatten(dispatch_48.ListB))
ln_59 = Line(StartPoint=pln_56, EndPoint=flatten_19)

# ----
# 定位点Project到下层建筑线
move2pt_26 = MoveToPoint(Geometry=pln_56, PointA=pln_56, PointB=flatten_19)  # -> Moved, Vector, Transform

deplane_41 = DeconstructPlane(Plane=move2pt_26.Moved)  # -> Origin, XAxis, YAxis, ZAxis
amp_41 = Amplitude(Vector=deplane_41.YAxis, Amplitude=Slider(5000, range=0..10000))
move_55 = Move(Geometry=deplane_41.Origin, Motion=amp_41)  # -> Geometry, Transform
ln_60 = Line(StartPoint=move_55.Geometry, EndPoint=deplane_41.Origin)
ccx_29 = CurveCurve(CurveA=graft(ln_60), CurveB=flatten(crv_68))  # -> simplify(Points), ParamsA, ParamsB
shift_6 = ShiftPaths(Data=ccx_29.Points, Offset=-1)
null_12 = NullItem(Item=shift_6)  # -> NullFlags, InvalidFlags, Description
dispatch_49 = Dispatch(List=simplify(graft(move2pt_26.Moved)), DispatchPattern=null_12.NullFlags)  # -> ListA, ListB
dispatch_50 = Dispatch(List=simplify(graft(ln_60)), DispatchPattern=null_12.NullFlags)  # -> ListA, ListB
pln_57 = Plane(dispatch_49.ListA)
crv_74 = Curve(dispatch_50.ListB)
pln_58 = Plane(dispatch_49.ListB)
ccx_30 = CurveCurve(CurveA=graft(crv_74), CurveB=flatten(crv_68))  # -> Points, ParamsA, ParamsB
shift_7 = ShiftPaths(Data=simplify(ccx_30.Points), Offset=-1)
pull_47 = PullPoint(Point=pln_58, Geometry=shift_7, ClosestOnly=True)  # -> ClosestPoint, Distance
sort_35 = SortList(Keys=pull_47.Distance, ValuesA=pull_47.ClosestPoint)  # -> Keys, ValuesA
item_78 = ListItem(List=sort_35.ValuesA, Index=0, Wrap=True)
ln_61 = Line(StartPoint=pln_58, EndPoint=item_78)
len_11 = Length(Curve=ln_61)
panel_57 = Panel(len_11)
larger_13 = LargerThan(FirstNumber=len_11, SecondNumber=number_slider_7)  # -> LargerThan, OrEqualTo
dispatch_51 = Dispatch(List=pln_58, DispatchPattern=larger_13.LargerThan)  # -> ListA, ListB
pln_59 = Plane(dispatch_51.ListB)
pln_60 = Plane(dispatch_51.ListA)

# ----
# 定位点离下层建筑边线太远
# ???怎么处理
pln_61 = Plane(dispatch_48.ListA)

# ----
# 1.2.1梁以内>350
# 
# 侧埋，钢板焊
# 03：钢板焊埋件[钢梁内侧]
# @钢边梁宽@钢边梁高
move2pt_27 = MoveToPoint(Geometry=pln_60, PointA=pln_60, PointB=item_78)  # -> Moved, Vector, Transform

# ==== cluster Cluster
G = ClusterInput()
rotate = Rotate(Geometry=G, Angle=3.141592654, Plane=PlaneXY(0, 0, 0))  # -> Geometry, Transform
boxprop = BoxProperties(Box=rotate.Geometry)  # -> Center, Diagonal, Area, Volume, Degeneracy
bbox = BoundingBox(Content=rotate.Geometry, Plane=PlaneXY(0, 0, 0))  # -> Box, Box_2
debox = DeconstructBox(Box=bbox.Box)  # -> Plane, X, Y, Z
pdecon = Deconstruct(Point=boxprop.Center)  # -> XComponent, YComponent, ZComponent
dedomain = DeconstructDomain(Domain=debox.Y)  # -> Start, End
pt = ConstructPoint(XCoordinate=pdecon.XComponent, YCoordinate=dedomain.Start, ZCoordinate=pdecon.ZComponent)
xy = XYPlane(Origin=Point(0, 0, 0))
pl_origin = PlaneOrigin(Base=xy, Origin=pt)
orient = Orient(Geometry=rotate.Geometry, Source=pl_origin, Target=xy)  # -> Geometry, Transform
G_2 = ClusterOutput(orient.Geometry)
